# Grasshopper definition KUKA_Zivid_Bridge.gh (Grasshopper 1.0.8)
# plug-ins: Watchdog, pln2euler, Display_Robot, FlipTCP, KUKA KR10 R1100-2, tacoSolver, WaitSec, ToolDefinition, Stream, Construct TCP, DeconstructTCP

watchdog = Watchdog(Active=True, MaxSec=10)

point = Point(Point(600, -30, 70))
point_2 = Point(Point(-0.06, 1.4, 212.29))
move = Move(Geometry=point, Motion=Vector(0, 0, 400))  # -> Geometry, Transform
xy_plane = XYPlane(Origin=point_2)
circle = Circle(Plane=move.Geometry, Radius=200)
pln2euler = Pln2euler(P1=xy_plane, P2=xy_plane)
brep = Brep(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)
tool_definition = ToolDefinition(ToolTCP=pln2euler, Geometry=brep, ToolWeight=0)
divide_curve = DivideCurve(Curve=circle, Count=25, Kinks=False)  # -> Points, Tangents, Parameters
vector_2pt = Vector2Pt(PointA=point, PointB=divide_curve.Points, Unitize=False)  # -> Vector, Length
kuka_kr10_r1100_2 = KUKA_KR10_R11002(IP="0", Tool=tool_definition)
plane_normal = PlaneNormal(Origin=divide_curve.Points, ZAxis=vector_2pt.Vector)
align_planes = AlignPlanes(Planes=plane_normal, Master=point)
waitsec = WaitSec(Time="5")
dispatch = Dispatch(List=align_planes, DispatchPattern=[True, False])  # -> ListA, ListB
construct_tcp = ConstructTCP(Plane=dispatch.ListA, Speed="5", CDIS="10", RC=0, Command="NULL ", ExternalAxis=0, ExternalAxis_2=0)
construct_tcp_2 = ConstructTCP(Plane=dispatch.ListB, Speed="5", CDIS="10", RC=0, Command=waitsec, ExternalAxis=0, ExternalAxis_2=0)
weave = Weave(Pattern=[0, 1], Stream0=construct_tcp, Stream1=construct_tcp_2, NullGaps=False)
display_robot = DisplayRobot(Robot=kuka_kr10_r1100_2, Index=Slider(0, range=0..24))  # -> RobotMesh, Axis
flip_tcp = FlipTCP(TCP=weave)
deconstruct_tcp = DeconstructTCP(TCP=flip_tcp)  # -> Target, Speed, Command, Configuration, CDIS, E1, E2
ik = IK(Robot=kuka_kr10_r1100_2, TCP=flip_tcp, Code=Toggle(False))  # -> Analysis, Data
planeaxis = PlaneAxis(P=deconstruct_tcp.Target, B=35)
panel = Panel(deconstruct_tcp.Command)
panel_2 = Panel(ik.Analysis)
panel_3 = Panel(deconstruct_tcp.Target)

point_3 = Point(Point(0, 6.549782938e-11, 199.1488196))
xy_plane_2 = XYPlane(Origin=point_3)
pln2euler_2 = Pln2euler(P1=xy_plane_2, P2=xy_plane_2)
brep_2 = Brep(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)
tool_definition_2 = ToolDefinition(ToolTCP=pln2euler_2, Geometry=brep_2, ToolWeight=0)
kuka_kr10_r1100_2_2 = KUKA_KR10_R11002(IP="0", Tool=tool_definition_2)

trigger = Trigger(Interval=1000, TimerInterval=1000, Target=python_3_script)  # disabled
command = ValueList({"Add Calibration Sample": ADD_SAMPLE, "Solve Calibration": SOLVE, "Capture": CAPTURE, "Reset Calibration": RESET, "Compute WCS": WCS}, selected="Capture")  # disabled
number_slider = Slider(50000, range=20000..50000)  # disabled
button = Button()  # disabled

# ----
# Kuka Robot Connection
point_4 = Point(Point(553.9923064, -52.48798783, 471.7673306))
point_5 = Point(Point(553.9923064, -52.48798783, 471.7673306))
merge = Merge(Data1=point_4, Data2=point_5)
planeaxis_2 = PlaneAxis(P=PlaneXY(0, 0, 0), B=35)
construct_tcp_3 = ConstructTCP(Plane=merge, Speed="5", CDIS="10", RC=0, Command="NULL ", ExternalAxis=0, ExternalAxis_2=0)
flip_tcp_2 = FlipTCP(TCP=construct_tcp_3)
display_robot_2 = DisplayRobot(Robot=kuka_kr10_r1100_2_2, Index=Slider(0, range=0..24))  # -> RobotMesh, Axis
ik_2 = IK(Robot=kuka_kr10_r1100_2_2, TCP=flip_tcp_2, Code=Toggle(True))  # -> Analysis, Data
trigger_2 = Trigger(Interval=10, TimerInterval=10, Target=stream)  # disabled
panel_4 = Panel(ik_2.Analysis)
stream = Stream(
    Robot="ROSO_KR10_White",
    Data=ik_2.Data,
    Connect=Toggle(False),
    Trigger=Button(),
    SpeedOverride=Slider(0, range=0..10),
    Run=Toggle(False))  # -> Data, Status, Axis, Position
panel_5 = Panel(stream.Axis)
panel_6 = Panel(stream.Data)
panel_7 = Panel(stream.Status)

file_path = FilePath("C:\Users\Sing\Desktop\NYCU MS\MS Y2 115-A\機器人視覺 X 木構\20260803test\0000.ply")  # disabled
python_3_script = Python3Script(baseUrl="http://127.0.0.1:8765")  # -> service, robotConnected, robotStationary, poseAge, robotAge, cameraConnected, samples, calibrated, lastCapture, raw; inputs baseUrl: String; disabled
# ---------- python_3_script: Python ----------
import json
import urllib.request

service = None
robotConnected = False
robotStationary = False
poseAge = None
robotPose = None
cameraConnected = False
samples = 0
calibrated = False
lastCapture = None
raw = None

if not baseUrl:
    baseUrl = "http://127.0.0.1:8765"

try:
    url = baseUrl.rstrip("/") + "/status"

    with urllib.request.urlopen(url, timeout=1.0) as response:
        text = response.read().decode("utf-8")
        data = json.loads(text)

    raw = json.dumps(data, indent=2)

    service = data.get("service")

    robot = data.get("robot", {})
    robotConnected = robot.get("connected", False)
    robotStationary = robot.get("stationary", False)
    poseAge = robot.get("pose_age_ms")
    robotPose = robot.get("raw_pose")

    camera = data.get("camera", {})
    cameraConnected = camera.get("connected", False)

    calibration = data.get("calibration", {})
    samples = calibration.get("sample_count", 0)
    calibrated = calibration.get("solved", False)

    capture = data.get("capture", {})
    lastCapture = capture.get("last_capture_id")

except Exception as e:
    service = "OFFLINE"
    raw = str(e)
# ---------- end python_3_script ----------
button_2 = Button()  # disabled
python_3_script_2 = Python3Script(baseUrl="http://127.0.0.1:8765", command=command, send=button)  # -> ok, message, response; inputs send: Boolean; disabled
# ---------- python_3_script_2: Python ----------
import json
import urllib.request
import scriptcontext as sc

if not baseUrl:
    baseUrl = "http://127.0.0.1:8765"

ok = False
message = ""
response = None

key = "ROBOT_VISION_COMMAND_" + str(ghenv.Component.InstanceGuid)

previous = sc.sticky.get(key, False)
current = bool(send)

# Rising edge only
trigger = current and not previous
sc.sticky[key] = current

endpoint_map = {
    "ADD_SAMPLE": "/calibration/sample",
    "SOLVE": "/calibration/solve",
    "CAPTURE": "/capture",
    "RESET": "/calibration/reset",
    "WCS": "/wcs/compute",
}

if trigger:

    endpoint = endpoint_map.get(str(command).upper())

    if endpoint is None:
        message = "Unknown command: {}".format(command)

    else:
        try:
            url = baseUrl.rstrip("/") + endpoint

            request = urllib.request.Request(
                url,
                data=b"{}",
                headers={
                    "Content-Type": "application/json"
                },
                method="POST"
            )

            with urllib.request.urlopen(
                request,
                timeout=120.0
            ) as r:

                text = r.read().decode("utf-8")
                data = json.loads(text)

            response = json.dumps(data, indent=2)

            ok = bool(data.get("ok", True))

            message = data.get(
                "message",
                "Command completed"
            )

        except Exception as e:
            ok = False
            message = str(e)
# ---------- end python_3_script_2 ----------

# ----
# Robot Status
trigger_3 = Trigger(Interval=1000, TimerInterval=1000, Target=python_3_script_3)  # disabled
python_3_script_3 = Python3Script(baseUrl="http://127.0.0.1:8765")  # -> service, connected, valid, stationary, age, seq, plane, info; inputs baseUrl: String
# ---------- python_3_script_3: Python ----------
import json
import urllib.request
import Rhino.Geometry as rg

service = None
connected = False
valid = False
stationary = False
age = None
seq = None
plane = None
info = ""

if not baseUrl:
    baseUrl = "http://127.0.0.1:8765"

try:
    url = baseUrl.rstrip("/") + "/status"

    with urllib.request.urlopen(url, timeout=1.0) as response:
        text = response.read().decode("utf-8")

    data = json.loads(text)

    service = data.get("service")

    robot = data.get("robot", {})

    connected = bool(robot.get("connected", False))
    valid = bool(robot.get("pose_valid", False))
    stationary = bool(robot.get("stationary", False))
    age = robot.get("pose_age_ms")
    seq = robot.get("seq")

    T = robot.get("T_base_flange")

    if T:
        # Translation
        origin = rg.Point3d(
            float(T[0][3]),
            float(T[1][3]),
            float(T[2][3])
        )

        # Rotation matrix columns = local axes
        xaxis = rg.Vector3d(
            float(T[0][0]),
            float(T[1][0]),
            float(T[2][0])
        )

        yaxis = rg.Vector3d(
            float(T[0][1]),
            float(T[1][1]),
            float(T[2][1])
        )

        plane = rg.Plane(
            origin,
            xaxis,
            yaxis
        )

    if connected and valid:
        info = "Robot UDP OK"
    else:
        info = "Robot UDP unavailable / stale"

except Exception as e:
    info = str(e)
# ---------- end python_3_script_3 ----------
panel_8 = Panel([python_3_script_3.service, python_3_script_3.connected, python_3_script_3.valid, python_3_script_3.stationary, python_3_script_3.age, python_3_script_3.seq])
panel_9 = Panel(python_3_script_3.info)
plane = Plane(python_3_script_3.plane)
symbol_simple = SymbolSimple(Style=5, Size=4.1, Rotation=0, Colour=RGBA(255, 0, 0, 139))
panel_10 = Panel(plane)

# ----
# Projection(Deviation Map)
maxpoints = Slider(10000, range=0..50000)
goodtol = Slider(1, range=0..5)
warntol = Slider(3, range=0..5)
radiuspx = Slider(3, range=0..5)
project = Button()
stop = Button()
refresh = Button()
python_3_script_4 = Python3Script(
    baseUrl="http://127.0.0.1:8765",
    project=project,
    stop=stop,
    refresh=refresh,
    mode="absolute",
    goodTol=goodtol,
    warnTol=warntol,
    palette="pure_rgb",
    radiusPx=radiuspx,
    maxPoints=maxpoints)  # -> active, projectionId, inputCount, sentCount, projectedCount, imagePath, status, raw; inputs baseUrl: String, project: Boolean, stop: Boolean, refresh: Boolean, points: Point3d, deviations: Double, mode: String, goodTol: Double, warnTol: Double, palette: String, radiusPx: Int32, maxPoints: Int32
#   port mode: absolute signed
#   port palette: pure_rgb semantic
# ---------- python_3_script_4: Python ----------
"""
Deviation Projection Client
Rhino 8 / Grasshopper / Python 3

This component DOES NOT connect directly to Zivid.

It sends:
    Base-frame 3D points
    + deviation values
to the external test02 Python Service.

Expected API
------------
POST /projection/deviation
POST /projection/stop
GET  /projection/status

Inputs
------
baseUrl : str
    e.g. http://127.0.0.1:8765

project : bool
    Rising edge -> project/update deviation map.

stop : bool
    Rising edge -> stop projector.

refresh : bool
    Rising edge -> get current projection status.

points : List[Point3d]
    MUST already be in KUKA Robot Base coordinates.

deviations : List[float]
    One deviation value per point, in mm.

mode : str
    "absolute" or "signed"

goodTol : float
    Good tolerance in mm.

warnTol : float
    Warning tolerance in mm.

palette : str
    "pure_rgb" recommended
    or "semantic"

radiusPx : int
    Projected dot radius.

maxPoints : int
    Maximum number sent through HTTP.
    <= 0 means no client-side limit.

Outputs
-------
active
projectionId
inputCount
sentCount
projectedCount
imagePath
status
raw
"""

import json
import math
import urllib.request
import urllib.error
import scriptcontext as sc


CACHE_KEY = "KUKA_ZIVID_DEVIATION_PROJECTION_CLIENT_V1"


# ============================================================
# Persistent state
# ============================================================

if CACHE_KEY not in sc.sticky:
    sc.sticky[CACHE_KEY] = {
        "prev_project": False,
        "prev_stop": False,
        "prev_refresh": False,

        "last_response": None,
        "last_status": "Deviation Projection Client ready",
    }

_cache = sc.sticky[CACHE_KEY]


# ============================================================
# Helpers
# ============================================================

def rising_edge(current, key):
    current = bool(current)
    previous = bool(_cache.get(key, False))

    edge = current and not previous
    _cache[key] = current

    return edge


def normalize_url(url):
    if not url:
        return "http://127.0.0.1:8765"

    return str(url).strip().rstrip("/")


def finite_number(value):
    try:
        x = float(value)
        return math.isfinite(x)
    except Exception:
        return False


def point_xyz(point):
    """
    Accept Rhino Point3d-like objects.
    """

    if point is None:
        return None

    try:
        x = float(point.X)
        y = float(point.Y)
        z = float(point.Z)

    except Exception:
        try:
            x = float(point[0])
            y = float(point[1])
            z = float(point[2])

        except Exception:
            return None

    if not (
        math.isfinite(x)
        and math.isfinite(y)
        and math.isfinite(z)
    ):
        return None

    return [x, y, z]


def request_json(
    method,
    endpoint,
    payload=None,
    timeout=30.0,
):
    url = normalize_url(baseUrl) + endpoint

    headers = {
        "Accept": "application/json",
    }

    body = None

    if payload is not None:
        body = json.dumps(
            payload,
            separators=(",", ":"),
        ).encode("utf-8")

        headers["Content-Type"] = "application/json"

    request = urllib.request.Request(
        url=url,
        data=body,
        headers=headers,
        method=method,
    )

    try:
        with urllib.request.urlopen(
            request,
            timeout=timeout,
        ) as response:

            text = response.read().decode("utf-8")

            if text.strip():
                result = json.loads(text)
            else:
                result = {"ok": True}

            if isinstance(result, dict):
                result["_http_status"] = response.status

            return result

    except urllib.error.HTTPError as exc:

        try:
            response_text = exc.read().decode("utf-8")
            result = json.loads(response_text)

        except Exception:
            result = {
                "error": "HTTP_ERROR",
                "detail": str(exc),
            }

        if not isinstance(result, dict):
            result = {
                "error": result,
            }

        result["ok"] = False
        result["_http_status"] = exc.code

        return result

    except urllib.error.URLError as exc:

        return {
            "ok": False,
            "error": "SERVICE_CONNECTION_ERROR",
            "detail": str(exc.reason),
        }

    except Exception as exc:

        return {
            "ok": False,
            "error": "PROJECTION_CLIENT_ERROR",
            "detail": str(exc),
        }


def nested_value(data, keys, default=None):
    if not isinstance(data, dict):
        return default

    containers = [data]

    for name in (
        "projection",
        "result",
        "data",
    ):
        value = data.get(name)

        if isinstance(value, dict):
            containers.append(value)

    for container in containers:
        for key in keys:

            if key in container:
                value = container[key]

                if value is not None:
                    return value

    return default


def classify_priority(
    deviation,
    good_tolerance,
    warning_tolerance,
):
    """
    Higher value = more important to preserve
    during client-side downsampling.

    BAD     -> 2
    WARNING -> 1
    GOOD    -> 0
    """

    magnitude = abs(float(deviation))

    if magnitude > warning_tolerance:
        return 2

    if magnitude > good_tolerance:
        return 1

    return 0


def deterministic_pick(items, target):
    """
    Stable even sampling.
    """

    count = len(items)

    if target <= 0 or count <= target:
        return items

    step = float(count) / float(target)

    output = []
    previous_index = -1

    for i in range(target):

        index = int(i * step)

        if index >= count:
            index = count - 1

        if index != previous_index:
            output.append(items[index])
            previous_index = index

    return output


def limit_points_by_priority(
    valid_rows,
    maximum,
    good_tolerance,
    warning_tolerance,
):
    """
    Preserve large deviations first.

    Each row:
        (xyz, deviation)
    """

    try:
        maximum = int(maximum)
    except Exception:
        maximum = 0

    if maximum <= 0:
        return valid_rows

    if len(valid_rows) <= maximum:
        return valid_rows

    bad = []
    warning = []
    good = []

    for row in valid_rows:

        priority = classify_priority(
            row[1],
            good_tolerance,
            warning_tolerance,
        )

        if priority == 2:
            bad.append(row)

        elif priority == 1:
            warning.append(row)

        else:
            good.append(row)

    selected = []

    # --------------------------------------------------------
    # BAD first
    # --------------------------------------------------------

    remaining = maximum - len(selected)

    if len(bad) >= remaining:
        return deterministic_pick(
            bad,
            remaining,
        )

    selected.extend(bad)

    # --------------------------------------------------------
    # WARNING second
    # --------------------------------------------------------

    remaining = maximum - len(selected)

    if remaining <= 0:
        return selected

    if len(warning) >= remaining:

        selected.extend(
            deterministic_pick(
                warning,
                remaining,
            )
        )

        return selected

    selected.extend(warning)

    # --------------------------------------------------------
    # GOOD last
    # --------------------------------------------------------

    remaining = maximum - len(selected)

    if remaining > 0:

        selected.extend(
            deterministic_pick(
                good,
                remaining,
            )
        )

    return selected


# ============================================================
# Input defaults
# ============================================================

projection_mode = (
    str(mode).strip().lower()
    if mode
    else "absolute"
)

if projection_mode not in (
    "absolute",
    "signed",
):
    projection_mode = "absolute"


projection_palette = (
    str(palette).strip().lower()
    if palette
    else "pure_rgb"
)

if projection_palette not in (
    "pure_rgb",
    "semantic",
):
    projection_palette = "pure_rgb"


try:
    good_tolerance = float(goodTol)
except Exception:
    good_tolerance = 1.0


try:
    warning_tolerance = float(warnTol)
except Exception:
    warning_tolerance = 3.0


if good_tolerance < 0:
    good_tolerance = abs(good_tolerance)

if warning_tolerance < good_tolerance:
    warning_tolerance = good_tolerance


try:
    point_radius = int(radiusPx)
except Exception:
    point_radius = 3

point_radius = max(
    1,
    min(50, point_radius),
)


try:
    maximum_points = int(maxPoints)
except Exception:
    maximum_points = 20000


# ============================================================
# Trigger detection
# ============================================================

do_project = rising_edge(
    project,
    "prev_project",
)

do_stop = rising_edge(
    stop,
    "prev_stop",
)

do_refresh = rising_edge(
    refresh,
    "prev_refresh",
)


command_count = sum(
    1
    for x in (
        do_project,
        do_stop,
        do_refresh,
    )
    if x
)


# ============================================================
# Prepare source data
# ============================================================

try:
    source_points = list(points) if points is not None else []
except Exception:
    source_points = []


try:
    source_deviations = (
        list(deviations)
        if deviations is not None
        else []
    )
except Exception:
    source_deviations = []


inputCount = min(
    len(source_points),
    len(source_deviations),
)


# ============================================================
# Execute
# ============================================================

response = None
sentCount = 0


if command_count > 1:

    response = {
        "ok": False,
        "error": "MULTIPLE_PROJECTION_COMMANDS",
        "detail": (
            "Trigger only one of project / stop / refresh "
            "during the same Grasshopper solution."
        ),
    }


elif do_project:

    # --------------------------------------------------------
    # Strict correspondence check
    # --------------------------------------------------------

    if len(source_points) != len(source_deviations):

        response = {
            "ok": False,
            "error": "POINT_DEVIATION_COUNT_MISMATCH",
            "detail": (
                "points={} deviations={}".format(
                    len(source_points),
                    len(source_deviations),
                )
            ),
        }

    else:

        valid_rows = []

        for point, deviation in zip(
            source_points,
            source_deviations,
        ):

            xyz = point_xyz(point)

            if xyz is None:
                continue

            if not finite_number(deviation):
                continue

            valid_rows.append(
                (
                    xyz,
                    float(deviation),
                )
            )

        selected_rows = limit_points_by_priority(
            valid_rows,
            maximum_points,
            good_tolerance,
            warning_tolerance,
        )

        points_payload = [
            row[0]
            for row in selected_rows
        ]

        deviations_payload = [
            row[1]
            for row in selected_rows
        ]

        sentCount = len(selected_rows)

        if sentCount == 0:

            response = {
                "ok": False,
                "error": "NO_VALID_PROJECTION_POINTS",
                "detail": (
                    "No finite Base-frame points "
                    "with finite deviation values."
                ),
            }

        else:

            payload = {
                "points_base": points_payload,
                "deviations_mm": deviations_payload,

                "mode": projection_mode,

                "good_tolerance_mm": good_tolerance,
                "warning_tolerance_mm": warning_tolerance,

                "palette": projection_palette,

                "point_radius_px": point_radius,
                "opacity": 255,
            }

            response = request_json(
                "POST",
                "/projection/deviation",
                payload,
                timeout=45.0,
            )


elif do_stop:

    response = request_json(
        "POST",
        "/projection/stop",
        {},
        timeout=15.0,
    )


elif do_refresh:

    response = request_json(
        "GET",
        "/projection/status",
        None,
        timeout=15.0,
    )


# ============================================================
# Cache response
# ============================================================

if response is not None:

    _cache["last_response"] = response

    if bool(response.get("ok", True)):

        _cache["last_status"] = "OK"

    else:

        error_code = response.get(
            "error",
            response.get(
                "code",
                "UNKNOWN_ERROR",
            ),
        )

        detail = response.get(
            "detail",
            response.get(
                "message",
                "",
            ),
        )

        _cache["last_status"] = (
            "{}: {}".format(
                error_code,
                detail,
            )
        )


data = _cache.get("last_response")


# ============================================================
# Outputs
# ============================================================

active = False
projectionId = None
projectedCount = 0
imagePath = None

status = _cache.get(
    "last_status",
    "Deviation Projection Client ready",
)

raw = None


if isinstance(data, dict):

    active = bool(
        nested_value(
            data,
            ["active"],
            False,
        )
    )

    projectionId = nested_value(
        data,
        [
            "projection_id",
            "projectionId",
        ],
        None,
    )

    projectedCount = nested_value(
        data,
        [
            "visible_projector_points",
            "projected_points",
            "visible_points",
        ],
        0,
    )

    imagePath = nested_value(
        data,
        [
            "image_path",
            "projector_image",
            "projectorImagePath",
        ],
        None,
    )

    raw = json.dumps(
        data,
        indent=2,
        ensure_ascii=False,
    )
# ---------- end python_3_script_4 ----------
panel_11 = Panel([python_3_script_4.imagePath, python_3_script_4.status])
panel_12 = Panel([python_3_script_4.active, python_3_script_4.projectionId])

# ----
# Single Capture
capture = Button()
python_3_script_5 = Python3Script(baseUrl="http://127.0.0.1:8765", capture=capture)  # -> ok, captureId, pointCount, previewCount, previewPath, plyPath, matrix, info; inputs capture: Boolean
# ---------- python_3_script_5: Python ----------
"""
Async Capture Client
Rhino 8 / Grasshopper / Python 3

Inputs
------
capture : bool
baseUrl : str

Outputs
-------
ok
captureId
pointCount
previewCount
previewPath
plyPath
matrix
busy
errorCode
httpStatus
info

Important
---------
- HTTP capture runs in a background thread.
- Grasshopper main solution returns immediately.
- Keep a GH Timer running so:
    1. UDP Publisher continues sending robot pose.
    2. This component periodically reads capture result.
"""

import json
import threading
import urllib.request
import urllib.error
import scriptcontext as sc


# ============================================================
# Configuration
# ============================================================

if not baseUrl:
    baseUrl = "http://127.0.0.1:8765"

BASE_URL = str(baseUrl).rstrip("/")

component_id = str(
    ghenv.Component.InstanceGuid
)

BUTTON_KEY = (
    "ASYNC_CAPTURE_BUTTON_" +
    component_id
)

STATE_KEY = (
    "ASYNC_CAPTURE_STATE_" +
    component_id
)

LOCK_KEY = (
    "ASYNC_CAPTURE_LOCK_" +
    component_id
)


# ============================================================
# Persistent lock
# ============================================================

if LOCK_KEY not in sc.sticky:
    sc.sticky[LOCK_KEY] = threading.Lock()

state_lock = sc.sticky[LOCK_KEY]


# ============================================================
# Persistent state
# ============================================================

if STATE_KEY not in sc.sticky:

    sc.sticky[STATE_KEY] = {

        "busy": False,

        "ok": False,

        "captureId": None,

        "pointCount": 0,

        "previewCount": 0,

        "previewPath": None,

        "plyPath": None,

        "matrix": None,

        "errorCode": None,

        "httpStatus": None,

        "info": "Ready"
    }


# ============================================================
# Helpers
# ============================================================

def parse_json(text):

    try:

        value = json.loads(text)

        if isinstance(value, dict):
            return value

    except Exception:
        pass

    return {}


def update_state(values):

    with state_lock:

        state = sc.sticky.get(
            STATE_KEY,
            {}
        )

        state.update(values)

        sc.sticky[
            STATE_KEY
        ] = state


# ============================================================
# Background HTTP Worker
# ============================================================

def capture_worker():

    try:

        url = (
            BASE_URL +
            "/capture"
        )

        request = urllib.request.Request(
            url,
            method="POST"
        )

        with urllib.request.urlopen(
            request,
            timeout=120.0
        ) as response:

            status = int(
                response.status
            )

            raw = response.read()

        text = raw.decode(
            "utf-8"
        )

        data = parse_json(
            text
        )

        files = (
            data.get("files")
            or {}
        )

        update_state({

            "busy":
                False,

            "ok":
                bool(
                    data.get(
                        "ok",
                        False
                    )
                ),

            "captureId":
                data.get(
                    "capture_id"
                ),

            "pointCount":
                int(
                    data.get(
                        "point_count",
                        0
                    )
                    or 0
                ),

            "previewCount":
                int(
                    data.get(
                        "preview_point_count",
                        0
                    )
                    or 0
                ),

            "previewPath":
                files.get(
                    "preview_xyz"
                ),

            "plyPath":
                files.get(
                    "ply"
                ),

            "matrix":
                data.get(
                    "T_base_camera"
                ),

            "errorCode":
                None,

            "httpStatus":
                status,

            "info":
                (
                    "CAPTURE COMPLETE\n"
                    "HTTP: {}\n"
                    "Capture: {}\n"
                    "Points: {}\n"
                    "Preview: {}"
                ).format(
                    status,
                    data.get(
                        "capture_id"
                    ),
                    data.get(
                        "point_count",
                        0
                    ),
                    data.get(
                        "preview_point_count",
                        0
                    )
                )
        })


    # ========================================================
    # Backend HTTP error
    # ========================================================

    except urllib.error.HTTPError as e:

        try:

            raw = e.read()

            text = raw.decode(
                "utf-8"
            )

            data = parse_json(
                text
            )

        except Exception:

            data = {}


        error_code = data.get(
            "error_code",
            "HTTP_ERROR"
        )

        message = data.get(
            "message",
            str(e)
        )

        details = data.get(
            "details"
        ) or {}


        update_state({

            "busy":
                False,

            "ok":
                False,

            "errorCode":
                error_code,

            "httpStatus":
                int(e.code),

            "info":
                (
                    "CAPTURE ERROR\n"
                    "HTTP: {}\n"
                    "Code: {}\n"
                    "Message: {}\n"
                    "Details:\n{}"
                ).format(
                    e.code,
                    error_code,
                    message,
                    json.dumps(
                        details,
                        indent=2,
                        ensure_ascii=False
                    )
                )
        })


    # ========================================================
    # Connection error
    # ========================================================

    except urllib.error.URLError as e:

        update_state({

            "busy":
                False,

            "ok":
                False,

            "errorCode":
                "SERVICE_UNAVAILABLE",

            "httpStatus":
                None,

            "info":
                (
                    "CAPTURE CONNECTION ERROR\n"
                    "{}"
                ).format(
                    e
                )
        })


    # ========================================================
    # Unexpected client error
    # ========================================================

    except Exception as e:

        update_state({

            "busy":
                False,

            "ok":
                False,

            "errorCode":
                "CLIENT_ERROR",

            "httpStatus":
                None,

            "info":
                (
                    "CAPTURE CLIENT ERROR\n"
                    "{}"
                ).format(
                    e
                )
        })


# ============================================================
# Rising-edge trigger
# ============================================================

previous = bool(
    sc.sticky.get(
        BUTTON_KEY,
        False
    )
)

current = bool(
    capture
)

trigger = (
    current
    and
    not previous
)

sc.sticky[
    BUTTON_KEY
] = current


# ============================================================
# Start background capture
# ============================================================

with state_lock:

    current_state = sc.sticky[
        STATE_KEY
    ]

    currently_busy = bool(
        current_state.get(
            "busy",
            False
        )
    )


if trigger:

    if currently_busy:

        update_state({

            "info":
                "CAPTURE BUSY\n"
                "Previous capture is still running."
        })

    else:

        update_state({

            "busy":
                True,

            "ok":
                False,

            "errorCode":
                None,

            "httpStatus":
                None,

            "info":
                "CAPTURE STARTED\n"
                "HTTP request running in background."
        })


        worker = threading.Thread(
            target=capture_worker,
            name="gh-capture-http",
            daemon=True
        )

        worker.start()


# ============================================================
# Read current state
# ============================================================

with state_lock:

    state = dict(
        sc.sticky[
            STATE_KEY
        ]
    )


# ============================================================
# Outputs
# ============================================================

ok = state.get(
    "ok",
    False
)

captureId = state.get(
    "captureId"
)

pointCount = state.get(
    "pointCount",
    0
)

previewCount = state.get(
    "previewCount",
    0
)

previewPath = state.get(
    "previewPath"
)

plyPath = state.get(
    "plyPath"
)

matrix = state.get(
    "matrix"
)

busy = state.get(
    "busy",
    False
)

errorCode = state.get(
    "errorCode"
)

httpStatus = state.get(
    "httpStatus"
)

info = state.get(
    "info",
    "Ready"
)
# ---------- end python_3_script_5 ----------
cluster = Cluster(text=[python_3_script_5.previewPath, python_3_script_5.plyPath])
panel_13 = Panel(cluster)
panel_14 = Panel([python_3_script_5.ok, python_3_script_5.captureId, python_3_script_5.pointCount, python_3_script_5.previewCount, python_3_script_5.info])

# ----
# Multi-view Scan
start = BooleanToggle(False)
capture_2 = Button()
merge_2 = Button()
finish = Button()
reset = Button()
refresh_2 = Button()
scan_client = Python3Script(
    baseUrl="http://127.0.0.1:8765",
    start=start,
    capture=capture_2,
    merge=merge_2,
    finish=finish,
    reset=reset,
    refresh=refresh_2)  # -> scanId, state, captureCount, active, merged, previewPath, cloudPath, manifestPath, status, raw; inputs baseUrl: String, start: Boolean, capture: Boolean, merge: Boolean, finish: Boolean, reset: Boolean, refresh: Boolean
# ---------- scan_client: Python ----------
"""
KUKA Zivid Async Scan Client
Rhino 8 / Grasshopper / Python 3

Purpose
-------
Control the external Python Service multi-view scan workflow without blocking
the Grasshopper solution. This is important because the Robot UDP Publisher
must continue to recompute while /scan/capture is acquiring a Zivid frame.

Inputs
------
baseUrl : str
    Example: http://127.0.0.1:8765

start : bool
    Rising edge -> POST /scan/start

capture : bool
    Rising edge -> POST /scan/capture

merge : bool
    Rising edge -> POST /scan/merge

finish : bool
    Rising edge -> POST /scan/finish

reset : bool
    Rising edge -> POST /scan/reset

refresh : bool
    Rising edge -> GET /scan/status

Outputs
-------
scanId
state
captureCount
active
merged
previewPath
cloudPath
manifestPath
busy
errorCode
httpStatus
status
raw

Important
---------
- HTTP work runs on a background thread.
- Do NOT call ExpireSolution() from the worker thread.
- Keep a GH Timer running (recommended 50-100 ms) so:
    1. UDP Publisher continues sending T_base_flange.
    2. This component periodically displays the completed HTTP result.
"""

import json
import threading
import urllib.request
import urllib.error
import scriptcontext as sc


# ============================================================
# Configuration
# ============================================================

BASE_URL = (
    "http://127.0.0.1:8765"
    if not baseUrl
    else str(baseUrl).strip().rstrip("/")
)

COMPONENT_ID = str(ghenv.Component.InstanceGuid)

CACHE_KEY = "KUKA_ZIVID_ASYNC_SCAN_CLIENT_" + COMPONENT_ID
LOCK_KEY = "KUKA_ZIVID_ASYNC_SCAN_LOCK_" + COMPONENT_ID


# ============================================================
# Persistent lock / state
# ============================================================

if LOCK_KEY not in sc.sticky:
    sc.sticky[LOCK_KEY] = threading.RLock()

_state_lock = sc.sticky[LOCK_KEY]

if CACHE_KEY not in sc.sticky:
    sc.sticky[CACHE_KEY] = {
        "prev_start": False,
        "prev_capture": False,
        "prev_merge": False,
        "prev_finish": False,
        "prev_reset": False,
        "prev_refresh": False,

        "busy": False,
        "operation": None,

        "last_response": None,
        "last_status": "Scan Client ready",

        "error_code": None,
        "http_status": None,
    }

_cache = sc.sticky[CACHE_KEY]


# ============================================================
# Helpers
# ============================================================

def rising_edge(current, key):
    """Return True only for False -> True."""
    current = bool(current)

    with _state_lock:
        previous = bool(_cache.get(key, False))
        edge = current and not previous
        _cache[key] = current

    return edge


def parse_json(text):
    try:
        value = json.loads(text)
        if isinstance(value, dict):
            return value
    except Exception:
        pass
    return {}


def first_value(data, keys, default=None):
    """Search root and common nested result containers."""
    if not isinstance(data, dict):
        return default

    containers = [data]

    for key in ("scan", "result", "data", "details"):
        nested = data.get(key)
        if isinstance(nested, dict):
            containers.append(nested)

    for container in containers:
        for key in keys:
            value = container.get(key)
            if value is not None:
                return value

    return default


def path_value(data, keys):
    value = first_value(data, keys, None)
    return None if value is None else str(value)


def backend_error_code(data, fallback="UNKNOWN_ERROR"):
    """Preserve FastAPI/BridgeError error_code instead of showing UNKNOWN_ERROR."""
    if not isinstance(data, dict):
        return fallback

    direct = (
        data.get("error_code")
        or data.get("error")
        or data.get("code")
    )
    if direct:
        return str(direct)

    details = data.get("details")
    if isinstance(details, dict):
        stationary = details.get("stationary_during_capture")
        if isinstance(stationary, dict) and stationary.get("reason"):
            return str(stationary["reason"])

        if details.get("reason"):
            return str(details["reason"])

    return fallback


def backend_message(data, fallback=""):
    if not isinstance(data, dict):
        return fallback

    return str(
        data.get("message")
        or data.get("detail")
        or data.get("error")
        or fallback
    )


def set_state(**values):
    with _state_lock:
        _cache.update(values)


# ============================================================
# Background HTTP
# ============================================================

def http_worker(operation_name, method, endpoint, data, timeout):
    url = BASE_URL + endpoint

    try:
        headers = {
            "Accept": "application/json",
        }

        payload = None

        if data is not None:
            payload = json.dumps(data).encode("utf-8")
            headers["Content-Type"] = "application/json"

        request = urllib.request.Request(
            url=url,
            data=payload,
            headers=headers,
            method=method,
        )

        with urllib.request.urlopen(
            request,
            timeout=timeout,
        ) as response:
            http_status = int(response.status)
            raw_bytes = response.read()

        text = raw_bytes.decode("utf-8") if raw_bytes else ""

        if text.strip():
            result = parse_json(text)
            if not result:
                result = {
                    "ok": True,
                    "text": text,
                }
        else:
            result = {
                "ok": True,
            }

        result["_http_status"] = http_status

        ok_value = bool(result.get("ok", True))

        if ok_value:
            message = backend_message(
                result,
                "{} complete".format(operation_name),
            )

            set_state(
                busy=False,
                operation=None,
                last_response=result,
                error_code=None,
                http_status=http_status,
                last_status=(
                    "{} OK\n"
                    "HTTP: {}\n"
                    "{}"
                ).format(
                    operation_name.upper(),
                    http_status,
                    message,
                ),
            )
        else:
            error_code = backend_error_code(result)
            message = backend_message(result, "Scan operation failed.")

            set_state(
                busy=False,
                operation=None,
                last_response=result,
                error_code=error_code,
                http_status=http_status,
                last_status=(
                    "{} ERROR\n"
                    "HTTP: {}\n"
                    "Code: {}\n"
                    "Message: {}"
                ).format(
                    operation_name.upper(),
                    http_status,
                    error_code,
                    message,
                ),
            )

    except urllib.error.HTTPError as exc:
        try:
            body = exc.read().decode("utf-8")
            parsed = parse_json(body)
        except Exception:
            parsed = {}

        if not parsed:
            parsed = {
                "ok": False,
                "message": str(exc),
            }

        parsed["ok"] = False
        parsed["_http_status"] = int(exc.code)

        error_code = backend_error_code(
            parsed,
            "HTTP_ERROR",
        )
        message = backend_message(
            parsed,
            str(exc),
        )

        details = parsed.get("details") or {}

        set_state(
            busy=False,
            operation=None,
            last_response=parsed,
            error_code=error_code,
            http_status=int(exc.code),
            last_status=(
                "{} ERROR\n"
                "HTTP: {}\n"
                "Code: {}\n"
                "Message: {}\n"
                "Details:\n{}"
            ).format(
                operation_name.upper(),
                exc.code,
                error_code,
                message,
                json.dumps(
                    details,
                    indent=2,
                    ensure_ascii=False,
                ),
            ),
        )

    except urllib.error.URLError as exc:
        result = {
            "ok": False,
            "error_code": "SERVICE_CONNECTION_ERROR",
            "message": str(exc.reason),
        }

        set_state(
            busy=False,
            operation=None,
            last_response=result,
            error_code="SERVICE_CONNECTION_ERROR",
            http_status=None,
            last_status=(
                "{} CONNECTION ERROR\n{}"
            ).format(
                operation_name.upper(),
                exc.reason,
            ),
        )

    except Exception as exc:
        result = {
            "ok": False,
            "error_code": "SCAN_CLIENT_ERROR",
            "message": str(exc),
        }

        set_state(
            busy=False,
            operation=None,
            last_response=result,
            error_code="SCAN_CLIENT_ERROR",
            http_status=None,
            last_status=(
                "{} CLIENT ERROR\n{}"
            ).format(
                operation_name.upper(),
                exc,
            ),
        )


def start_async_operation(operation_name, method, endpoint, data=None, timeout=15.0):
    with _state_lock:
        if bool(_cache.get("busy", False)):
            existing = _cache.get("operation")

            _cache["last_status"] = (
                "SCAN CLIENT BUSY\n"
                "Current operation: {}\n"
                "Ignored new operation: {}"
            ).format(
                existing or "UNKNOWN",
                operation_name,
            )
            return False

        _cache["busy"] = True
        _cache["operation"] = operation_name
        _cache["error_code"] = None
        _cache["http_status"] = None
        _cache["last_status"] = (
            "{} STARTED\n"
            "HTTP request is running in background.\n"
            "Keep GH Timer / UDP Publisher running."
        ).format(
            operation_name.upper()
        )

    worker = threading.Thread(
        target=http_worker,
        args=(
            operation_name,
            method,
            endpoint,
            data,
            timeout,
        ),
        name="gh-scan-{}".format(operation_name),
        daemon=True,
    )
    worker.start()

    return True


# ============================================================
# Rising edge detection
# ============================================================

do_start = rising_edge(start, "prev_start")
do_capture = rising_edge(capture, "prev_capture")
do_merge = rising_edge(merge, "prev_merge")
do_finish = rising_edge(finish, "prev_finish")
do_reset = rising_edge(reset, "prev_reset")
do_refresh = rising_edge(refresh, "prev_refresh")


operations = [
    do_start,
    do_capture,
    do_merge,
    do_finish,
    do_reset,
    do_refresh,
]

operation_count = sum(
    1
    for item in operations
    if item
)


# ============================================================
# Start at most one operation per GH solution
# ============================================================

if operation_count > 1:
    set_state(
        error_code="MULTIPLE_SCAN_COMMANDS",
        last_status=(
            "MULTIPLE_SCAN_COMMANDS\n"
            "Only trigger one Scan Client command at a time."
        ),
    )

elif do_start:
    start_async_operation(
        "start",
        "POST",
        "/scan/start",
        {},
        timeout=15.0,
    )

elif do_capture:
    start_async_operation(
        "capture",
        "POST",
        "/scan/capture",
        {},
        timeout=120.0,
    )

elif do_merge:
    start_async_operation(
        "merge",
        "POST",
        "/scan/merge",
        {},
        timeout=180.0,
    )

elif do_finish:
    start_async_operation(
        "finish",
        "POST",
        "/scan/finish",
        {},
        timeout=180.0,
    )

elif do_reset:
    start_async_operation(
        "reset",
        "POST",
        "/scan/reset",
        {},
        timeout=30.0,
    )

elif do_refresh:
    start_async_operation(
        "refresh",
        "GET",
        "/scan/status",
        None,
        timeout=15.0,
    )


# ============================================================
# Snapshot current state for outputs
# ============================================================

with _state_lock:
    data = _cache.get("last_response")
    busy = bool(_cache.get("busy", False))
    errorCode = _cache.get("error_code")
    httpStatus = _cache.get("http_status")
    status = _cache.get(
        "last_status",
        "Scan Client ready",
    )


# ============================================================
# Outputs
# ============================================================

scanId = None
state = None
captureCount = 0
active = False
merged = False

previewPath = None
cloudPath = None
manifestPath = None

raw = None


if isinstance(data, dict):

    scanId = first_value(
        data,
        ["scan_id", "scanId"],
        None,
    )

    state = first_value(
        data,
        ["state", "status"],
        None,
    )

    captureCount = first_value(
        data,
        ["capture_count", "captureCount"],
        0,
    )

    active = bool(
        first_value(
            data,
            ["active"],
            False,
        )
    )

    merged = bool(
        first_value(
            data,
            ["merged", "is_merged"],
            False,
        )
    )

    previewPath = path_value(
        data,
        [
            "preview_path",
            "previewPath",
            "merged_preview_path",
            "merged_preview_xyzrgb",
            "preview_xyzrgb",
        ],
    )

    cloudPath = path_value(
        data,
        [
            "cloud_path",
            "cloudPath",
            "merged_cloud_path",
            "merged_cloud_downsampled",
        ],
    )

    manifestPath = path_value(
        data,
        [
            "manifest_path",
            "manifestPath",
            "scan_manifest",
        ],
    )

    raw = json.dumps(
        data,
        indent=2,
        ensure_ascii=False,
    )
# ---------- end scan_client ----------
cluster_2 = Cluster(text=[scan_client.previewPath, scan_client.cloudPath, scan_client.manifestPath])
panel_15 = Panel([scan_client.scanId, scan_client.state, scan_client.captureCount, scan_client.active, scan_client.merged])
panel_16 = Panel(cluster_2)
panel_17 = Panel(scan_client.status)

python_3_script_6 = Python3Script(path=file_path, load=button_2, maxPoints=number_slider)  # -> points, count, info; inputs load: Boolean, maxPoints: Int32; disabled
# ---------- python_3_script_6: Python ----------
import os
import Rhino.Geometry as rg

points = []
count = 0
info = ""

if maxPoints is None:
    maxPoints = 50000

if load and path:

    if not os.path.isfile(path):
        info = "File not found: " + str(path)

    else:
        try:
            pts = []

            with open(path, "r") as f:

                for line in f:

                    if len(pts) >= int(maxPoints):
                        break

                    line = line.strip()

                    if not line:
                        continue

                    values = line.split()

                    if len(values) < 3:
                        continue

                    x = float(values[0])
                    y = float(values[1])
                    z = float(values[2])

                    pts.append(
                        rg.Point3d(x, y, z)
                    )

            points = pts
            count = len(points)

            info = "Loaded {} preview points".format(count)

        except Exception as e:

            points = []
            count = 0
            info = str(e)
# ---------- end python_3_script_6 ----------
panel_18 = Panel(python_3_script.robotAge)  # disabled
panel_19 = Panel([python_3_script.cameraConnected, python_3_script.samples, python_3_script.calibrated])  # disabled
panel_20 = Panel([python_3_script.service, python_3_script.robotConnected, python_3_script.robotStationary, python_3_script.poseAge])
panel_21 = Panel([python_3_script_2.ok, python_3_script_2.message, python_3_script_2.response])  # disabled
panel_22 = Panel(python_3_script.raw)  # disabled
panel_23 = Panel("C:\Users\Sing\Desktop\NYCU MS\MS Y2 115-A\機器人視覺 X 木構\test02\data\scans\scan_0004\merged_preview.xyzrgb")

symbol_display = SymbolDisplay(Location=plane, Display=symbol_simple)
planeaxis_3 = PlaneAxis(P=plane, B=50)

# ---- group: mark point
point_6 = Point(Point(358.5929871, 29.36229706, 33.24160767))
point_7 = Point(Point(357.8421326, 29.19069099, 32.64293671))
panel_24 = Panel(point_6)

# ----
file_path_2 = FilePath(panel_23)

# ----
# Load Preview
point_count = Slider(10000, range=10000..50000)
load = BooleanToggle(True)
python_3_script_7 = Python3Script(path=file_path_2, load=load, maxPoints=point_count)  # -> points, count, cloud, colors, hasColor, info; inputs load: Boolean, maxPoints: Int32
# ---------- python_3_script_7: Python ----------
"""
Colored PointCloud Preview Loader
Rhino 8 / Grasshopper / Python 3

Supported formats
-----------------
XYZ:
    X Y Z

XYZRGB:
    X Y Z R G B

Inputs
------
load : bool
    Rising edge loads/reloads the file.

path : str
    Path to .xyz or .xyzrgb file.

maxPoints : int, optional
    Maximum number of preview points.
    <= 0 means no additional limit.

Outputs
-------
cloud : Rhino.Geometry.PointCloud
    Colored PointCloud when RGB is available.

points : list[Rhino.Geometry.Point3d]

colors : list[System.Drawing.Color]

count : int

hasColor : bool

info : str
"""

import os
import math
import Rhino
import System.Drawing
import scriptcontext as sc


CACHE_KEY = "KUKA_ZIVID_LOAD_PREVIEW_V2"

if CACHE_KEY not in sc.sticky:
    sc.sticky[CACHE_KEY] = {
        "prev_load": False,
        "path": None,
        "cloud": None,
        "points": [],
        "colors": [],
        "count": 0,
        "has_color": False,
        "info": "Preview not loaded",
    }

_cache = sc.sticky[CACHE_KEY]


# ============================================================
# Helpers
# ============================================================

def is_finite_xyz(x, y, z):
    return (
        math.isfinite(x)
        and math.isfinite(y)
        and math.isfinite(z)
    )


def clamp_color(v):
    try:
        value = int(round(float(v)))
    except Exception:
        value = 0

    return max(0, min(255, value))


def rising_edge(value):
    current = bool(value)
    previous = bool(_cache.get("prev_load", False))

    edge = current and not previous

    _cache["prev_load"] = current

    return edge


def deterministic_indices(count, target):
    """
    Evenly sample point indices.

    Unlike random sampling this gives stable previews
    between Grasshopper recomputes.
    """

    if target is None:
        return range(count)

    try:
        target = int(target)
    except Exception:
        return range(count)

    if target <= 0 or count <= target:
        return range(count)

    step = float(count) / float(target)

    indices = []
    previous = -1

    for i in range(target):
        idx = int(i * step)

        if idx >= count:
            idx = count - 1

        if idx != previous:
            indices.append(idx)
            previous = idx

    return indices


def read_preview(file_path, max_points):
    if not file_path:
        raise ValueError("Preview path is empty")

    file_path = os.path.abspath(
        os.path.expanduser(str(file_path))
    )

    if not os.path.isfile(file_path):
        raise FileNotFoundError(
            "Preview file not found: {}".format(file_path)
        )

    xyz_values = []
    rgb_values = []

    detected_color = None

    invalid_lines = 0

    with open(
        file_path,
        "r",
        encoding="utf-8",
        errors="ignore",
    ) as f:

        for line_number, line in enumerate(f, start=1):

            line = line.strip()

            if not line:
                continue

            if line.startswith("#"):
                continue

            parts = line.replace(",", " ").split()

            # --------------------------------------------
            # Determine format from first useful row
            # --------------------------------------------

            if detected_color is None:

                if len(parts) >= 6:
                    detected_color = True

                elif len(parts) >= 3:
                    detected_color = False

                else:
                    invalid_lines += 1
                    continue

            # --------------------------------------------
            # Parse XYZ
            # --------------------------------------------

            try:
                x = float(parts[0])
                y = float(parts[1])
                z = float(parts[2])
            except Exception:
                invalid_lines += 1
                continue

            if not is_finite_xyz(x, y, z):
                invalid_lines += 1
                continue

            # --------------------------------------------
            # Parse RGB
            # --------------------------------------------

            if detected_color:

                if len(parts) < 6:
                    invalid_lines += 1
                    continue

                try:
                    r = clamp_color(parts[3])
                    g = clamp_color(parts[4])
                    b = clamp_color(parts[5])
                except Exception:
                    invalid_lines += 1
                    continue

                rgb_values.append((r, g, b))

            xyz_values.append((x, y, z))

    if not xyz_values:
        raise ValueError(
            "Preview file contains no valid XYZ points"
        )

    # Safety: RGB and XYZ must have identical count.
    if detected_color:

        if len(rgb_values) != len(xyz_values):
            raise ValueError(
                "XYZ/RGB count mismatch: XYZ={}, RGB={}".format(
                    len(xyz_values),
                    len(rgb_values),
                )
            )

    # ====================================================
    # Deterministic preview sampling
    # ====================================================

    indices = deterministic_indices(
        len(xyz_values),
        max_points,
    )

    rhino_points = []
    rhino_colors = []

    point_cloud = Rhino.Geometry.PointCloud()

    for index in indices:

        x, y, z = xyz_values[index]

        pt = Rhino.Geometry.Point3d(
            x,
            y,
            z,
        )

        rhino_points.append(pt)

        if detected_color:

            r, g, b = rgb_values[index]

            color = System.Drawing.Color.FromArgb(
                r,
                g,
                b,
            )

            rhino_colors.append(color)

            point_cloud.Add(
                pt,
                color,
            )

        else:

            point_cloud.Add(pt)

    information = []

    information.append(
        "Preview loaded"
    )

    information.append(
        "File: {}".format(file_path)
    )

    information.append(
        "Format: {}".format(
            "XYZRGB" if detected_color else "XYZ"
        )
    )

    information.append(
        "Source valid points: {}".format(
            len(xyz_values)
        )
    )

    information.append(
        "Preview points: {}".format(
            point_cloud.Count
        )
    )

    information.append(
        "Color: {}".format(
            "available" if detected_color else "unavailable"
        )
    )

    if invalid_lines:
        information.append(
            "Skipped invalid rows: {}".format(
                invalid_lines
            )
        )

    return (
        file_path,
        point_cloud,
        rhino_points,
        rhino_colors,
        bool(detected_color),
        "\n".join(information),
    )


# ============================================================
# Load
# ============================================================

do_load = rising_edge(load)


if do_load:

    try:

        (
            loaded_path,
            loaded_cloud,
            loaded_points,
            loaded_colors,
            loaded_has_color,
            loaded_info,
        ) = read_preview(
            path,
            maxPoints,
        )

        _cache["path"] = loaded_path
        _cache["cloud"] = loaded_cloud
        _cache["points"] = loaded_points
        _cache["colors"] = loaded_colors
        _cache["count"] = loaded_cloud.Count
        _cache["has_color"] = loaded_has_color
        _cache["info"] = loaded_info

    except Exception as exc:

        _cache["info"] = (
            "Load Preview ERROR\n{}".format(exc)
        )


# ============================================================
# Outputs
# ============================================================

cloud = _cache.get("cloud")
points = _cache.get("points", [])
colors = _cache.get("colors", [])
count = _cache.get("count", 0)
hasColor = _cache.get("has_color", False)
info = _cache.get("info", "Preview not loaded")
# ---------- end python_3_script_7 ----------
panel_25 = Panel(python_3_script_7.info)

sub_list = SubList(List=panel_5, Domain=Domain(0, 5), Wrap=True)  # -> List, Index
panel_26 = Panel("""CALIBRATION
────────────────────────

ZividConnection
      ↓
MainCapture
      ↓
Hand-Eye Calibration
      ↓
calibration_results.yaml""")
point_cloud_attributes = PointCloudAttributes(Cloud=python_3_script_7.cloud, Colours=python_3_script_7.colors)  # -> Cloud, Locations, Normals, Colours, Hidden

# ----
# ZividConnection(For Eye-in-Hand Calibration)
camera_connection = BooleanToggle(False)
capture_3 = Button()
connectiontest = Python3Script(c=camera_connection)  # -> out, s, b, info; inputs c: Boolean
# ---------- connectiontest: Python ----------
# venv: zivid-2-18
# requirements: zivid==2.18.0

import zivid


# -----------------------------------------
# Persistent state
# -----------------------------------------

if "app" not in globals():
    app = None

if "camera" not in globals():
    camera = None

if "settings" not in globals():
    settings = None


# -----------------------------------------
# CONNECT
# -----------------------------------------

if c:

    try:

        if app is None:
            app = zivid.Application()

        if camera is None:
            camera = app.connect_camera()

        if settings is None:
            settings = zivid.Settings(
                acquisitions=[
                    zivid.Settings.Acquisition()
                ],
                color=zivid.Settings2D(
                    acquisitions=[
                        zivid.Settings2D.Acquisition()
                    ]
                ),
            )

        info = "Zivid connected"

    except Exception as e:

        info = "ERROR: {}".format(e)


# -----------------------------------------
# DISCONNECT
# -----------------------------------------

else:

    if camera is not None:

        try:
            camera.disconnect()
        except:
            pass

    camera = None

    info = "Zivid disconnected"


# -----------------------------------------
# OUTPUT
# -----------------------------------------

s = settings
b = camera
# ---------- end connectiontest ----------
zivid_connection_status = Panel(connectiontest.info)
maincapture = Python3Script(c=capture_3, s=connectiontest.s, b=connectiontest.b)  # -> out, frame, xyz, rgba, centerPt, status; inputs c: Boolean
# ---------- maincapture: Python ----------
# venv: zivid-2-18
# requirements: zivid==2.18.0

import zivid
import numpy as np


# ============================================================
# Persistent data
# ============================================================

if "_frame" not in globals():
    _frame = None

if "_xyz" not in globals():
    _xyz = None

if "_rgba" not in globals():
    _rgba = None

if "_status" not in globals():
    _status = "Waiting for capture"

if "_prev_c" not in globals():
    _prev_c = False


# ============================================================
# Button rising edge
# ============================================================

capture_now = bool(c) and not _prev_c
_prev_c = bool(c)


# ============================================================
# Capture
# ============================================================

if capture_now:

    if b is None:

        _status = (
            "CAPTURE ERROR\n"
            "Camera is None"
        )

    elif s is None:

        _status = (
            "CAPTURE ERROR\n"
            "Settings is None"
        )

    else:

        try:

            # -----------------------------------------------
            # Capture Zivid frame
            # -----------------------------------------------

            _frame = b.capture_2d_3d(s)


            # -----------------------------------------------
            # Get point cloud
            # -----------------------------------------------

            pc = _frame.point_cloud()


            # -----------------------------------------------
            # XYZ
            # shape = H x W x 3
            # -----------------------------------------------

            _xyz = pc.copy_data("xyz")


            # -----------------------------------------------
            # RGBA
            # shape = H x W x 4
            # -----------------------------------------------

            _rgba = pc.copy_data("rgba")


            # -----------------------------------------------
            # Check
            # -----------------------------------------------

            h = _xyz.shape[0]
            w = _xyz.shape[1]

            valid_count = int(
                np.isfinite(_xyz).all(axis=2).sum()
            )


            _status = (
                "CAPTURE OK\n"
                "XYZ shape: {}\n"
                "RGBA shape: {}\n"
                "Resolution: {} x {}\n"
                "Valid XYZ: {}"
            ).format(
                _xyz.shape,
                _rgba.shape,
                w,
                h,
                valid_count
            )


        except Exception as e:

            _status = (
                "CAPTURE ERROR\n{}"
            ).format(e)


# ============================================================
# Grasshopper Outputs
#
# 這四行非常重要
# ============================================================

frame = _frame
xyz = _xyz
rgba = _rgba
status = _status
# ---------- end maincapture ----------
panel_27 = Panel(maincapture.status)

plane_2 = Plane(stream.Position)

# ----
# UDP Publisher
reset_2 = BooleanToggle(False)
enable = BooleanToggle(False)
trigger_4 = Trigger(Interval=50, TimerInterval=50, Target=udp_publisher)  # disabled
udp_publisher = Python3Script(enable=enable, axis=sub_list.List, T=plane_2, ip="127.0.0.1", port="49152", reset_session=reset_2)  # -> sent, seq, session, packet, matrix, info; inputs enable: Boolean, axis: list of Double, T: Plane, ip: String, port: Int32, robot_state: String, reset_session: Boolean
# ---------- udp_publisher: Python ----------
"""
KUKA Robot State UDP Publisher
Rhino 8 / Grasshopper / Python 3

Purpose
-------
Publish the current KUKA robot pose from Grasshopper to the existing
Python RobotUDPServer.

Architecture
------------
KUKA / Taco
    -> Grasshopper Axis + Flange Plane
    -> Robot Pose.py
    -> T_base_flange
    -> THIS COMPONENT
    -> UDP 127.0.0.1:49152
    -> Python RobotUDPServer

Inputs
------
enable          : bool
axis            : list[float], optional diagnostic A1-A6
T               : Rhino.Geometry.Plane or Rhino.Geometry.Transform
                  Flange pose in Base frame (T_base_flange)
ip              : str, default "127.0.0.1"
port            : int, default 49152
robot_state     : str, default "UNKNOWN"
reset_session   : bool

Outputs
-------
sent            : bool
seq             : int
session         : str
packet          : JSON text
matrix          : 4x4 nested list
info            : status text

Important
---------
- One Grasshopper solution sends at most ONE UDP packet.
- Do NOT put while True in this component.
- Use a GH Timer for continuous streaming.
- Sender timestamp is metadata only.
- Python RobotUDPServer must continue using server-side monotonic time
  for freshness.
- T is authoritative. Axis data is diagnostic metadata only.
- T may be a Rhino Plane or Transform.
- A Plane is interpreted as the flange coordinate frame expressed in Base.
"""

import socket
import json
import time
import uuid
import math

import numpy as np


# ============================================================
# Configuration
# ============================================================

UDP_IP = str(ip) if ip else "127.0.0.1"
UDP_PORT = int(port) if port else 49152

ROBOT_ID = "KUKA_KR10_R1100_sixx"


# ============================================================
# Persistent State
#
# Grasshopper recomputes this script repeatedly.
# These globals preserve:
#
# - UDP socket
# - session_id
# - sequence number
# - packet count
# ============================================================

if "_udp_socket" not in globals():
    _udp_socket = socket.socket(
        socket.AF_INET,
        socket.SOCK_DGRAM
    )

if "_udp_session_id" not in globals():
    _udp_session_id = "gh-kuka-{}".format(
        uuid.uuid4()
    )

if "_udp_seq" not in globals():
    _udp_seq = 0

if "_udp_packet_count" not in globals():
    _udp_packet_count = 0

if "_udp_last_send_time" not in globals():
    _udp_last_send_time = None

if "_udp_session_started" not in globals():
    _udp_session_started = time.time()

if "_prev_reset_session" not in globals():
    _prev_reset_session = False


# ============================================================
# Rising Edge
#
# reset_session should be a Button.
# ============================================================

reset_now = (
    bool(reset_session)
    and
    not _prev_reset_session
)

_prev_reset_session = bool(reset_session)


# ============================================================
# Reset Sender Session
# ============================================================

if reset_now:

    _udp_session_id = "gh-kuka-{}".format(
        uuid.uuid4()
    )

    _udp_seq = 0
    _udp_packet_count = 0
    _udp_last_send_time = None
    _udp_session_started = time.time()


# ============================================================
# Helpers
# ============================================================

def is_finite(value):

    try:
        return math.isfinite(
            float(value)
        )

    except Exception:
        return False


def _unwrap_grasshopper_value(value):

    """Best-effort unwrap for common Grasshopper goo wrappers."""

    if value is None:
        return None

    try:
        inner = value.Value
        if inner is not None and inner is not value:
            return inner
    except Exception:
        pass

    return value


def rhino_pose_to_numpy(pose):

    """
    Rhino Plane OR Rhino Transform
    ->
    NumPy 4x4 T_base_flange

    Expected semantic:
        The input pose expresses the FLANGE frame in the BASE frame.

    Convention:
        p_base = T_base_flange @ p_flange

    Plane interpretation:
        Origin = flange origin expressed in Base
        XAxis  = flange X axis expressed in Base
        YAxis  = flange Y axis expressed in Base
        ZAxis  = flange Z axis expressed in Base

    The matrix is therefore constructed as:

        [ Xx  Yx  Zx  Ox ]
        [ Xy  Yy  Zy  Oy ]
        [ Xz  Yz  Zz  Oz ]
        [  0   0   0   1 ]
    """

    pose = _unwrap_grasshopper_value(pose)

    if pose is None:
        raise ValueError(
            "T_base_flange is None"
        )


    # --------------------------------------------------------
    # Case 2: Rhino.Geometry.Plane (or Plane-like)
    # --------------------------------------------------------
    plane_fields = (
        "Origin",
        "XAxis",
        "YAxis",
        "ZAxis"
    )

    if all(hasattr(pose, name) for name in plane_fields):

        origin = pose.Origin
        x_axis = pose.XAxis
        y_axis = pose.YAxis
        z_axis = pose.ZAxis

        A = np.array(
            [
                [x_axis.X, y_axis.X, z_axis.X, origin.X],
                [x_axis.Y, y_axis.Y, z_axis.Y, origin.Y],
                [x_axis.Z, y_axis.Z, z_axis.Z, origin.Z],
                [0.0,      0.0,      0.0,      1.0]
            ],
            dtype=np.float64
        )

        return A, "Plane"

    raise TypeError(
        "T must be a Rhino Plane or Transform; received {}".format(
            type(pose).__name__
        )
    )


def validate_transform(A):

    """
    Validate rigid transformation numerically.

    This only proves numerical validity.
    It does NOT prove that the physical frame semantics are correct.
    """

    if A.shape != (4, 4):
        raise ValueError(
            "T_base_flange must be 4x4"
        )

    if not np.isfinite(A).all():
        raise ValueError(
            "T_base_flange contains NaN / Inf"
        )

    expected_last_row = np.array(
        [0.0, 0.0, 0.0, 1.0],
        dtype=np.float64
    )

    if not np.allclose(
        A[3, :],
        expected_last_row,
        atol=1e-6
    ):
        raise ValueError(
            "Invalid homogeneous last row"
        )

    R = A[:3, :3]

    determinant = float(
        np.linalg.det(R)
    )

    orthogonal_error = float(
        np.linalg.norm(
            R.T @ R - np.eye(3)
        )
    )

    if abs(
        determinant - 1.0
    ) > 0.01:

        raise ValueError(
            "Invalid rotation determinant: {:.6f}".format(
                determinant
            )
        )

    if orthogonal_error > 0.01:

        raise ValueError(
            "Rotation orthogonal error too large: {:.8f}".format(
                orthogonal_error
            )
        )

    return (
        determinant,
        orthogonal_error
    )


def validate_joints(values):

    """
    A1-A6 are optional diagnostic metadata.

    They are NOT used to recompute T_base_flange.
    """

    if values is None:
        return None

    joints = [
        float(v)
        for v in values
    ]

    if len(joints) != 6:

        raise ValueError(
            "Expected 6 joint values A1-A6, got {}".format(
                len(joints)
            )
        )

    if not all(
        is_finite(v)
        for v in joints
    ):

        raise ValueError(
            "Joint values contain NaN / Inf"
        )

    return joints


# ============================================================
# Default Outputs
# ============================================================

sent = False

seq = _udp_seq

session = _udp_session_id

packet = None

matrix = None

info = (
    "UDP Publisher: DISABLED\n"
    "Destination: {}:{}\n"
    "Session: {}"
).format(
    UDP_IP,
    UDP_PORT,
    _udp_session_id
)


# ============================================================
# Publish
# ============================================================

if bool(enable):

    try:

        # ====================================================
        # 1. Validate T_base_flange
        # ====================================================

        T_np, pose_input_type = rhino_pose_to_numpy(
            T
        )

        determinant, orthogonal_error = (
            validate_transform(
                T_np
            )
        )

        matrix = T_np.tolist()


        # ====================================================
        # 2. Validate optional Joint values
        # ====================================================

        joints = validate_joints(
            axis
        )


        # ====================================================
        # 3. Sequence
        #
        # Increment only after successful send.
        # ====================================================

        next_seq = (
            _udp_seq
            +
            1
        )


        # ====================================================
        # 4. Robot State
        # ====================================================

        if robot_state is None:

            state_value = "UNKNOWN"

        else:

            state_value = (
                str(robot_state)
                .strip()
                .upper()
            )

            if not state_value:
                state_value = "UNKNOWN"


        # ====================================================
        # 5. Build packet
        #
        # IMPORTANT:
        # This follows the existing hardened RobotUDPServer
        # contract.
        # ====================================================

        payload = {

            "type":
                "POSE",

            "session_id":
                _udp_session_id,

            "seq":
                next_seq,

            # Sender wall-clock timestamp.
            #
            # This is metadata only.
            # The backend must continue using receive-side
            # time.monotonic() for freshness.
            "timestamp":
                time.time(),

            "T_base_flange":
                matrix,

            "state":
                state_value,

            # ------------------------------------------------
            # Pose semantic metadata
            # ------------------------------------------------

            "matrix_name":
                "T_base_flange",

            "source_frame":
                "flange",

            "target_frame":
                "base",

            "units":
                "mm",

            "source_variable":
                "Grasshopper Robot Pose",

            "robot_id":
                ROBOT_ID
        }


        # ====================================================
        # 6. Optional Joint Metadata
        #
        # IMPORTANT:
        #
        # If the current RobotUDPServer does NOT yet support
        # "joints" / "joint_unit", comment this block out.
        #
        # T_base_flange remains authoritative.
        # ====================================================

        if joints is not None:

            payload["joints"] = joints
            payload["joint_unit"] = "deg"


        # ====================================================
        # 7. Serialize
        # ====================================================

        json_text = json.dumps(
            payload,
            separators=(",", ":"),
            allow_nan=False
        )

        data = json_text.encode(
            "utf-8"
        )


        # ====================================================
        # 8. UDP Send
        # ====================================================

        _udp_socket.sendto(
            data,
            (
                UDP_IP,
                UDP_PORT
            )
        )


        # ====================================================
        # 9. Commit sender state
        #
        # Only after sendto() succeeds.
        # ====================================================

        _udp_seq = next_seq

        _udp_packet_count += 1

        _udp_last_send_time = (
            time.time()
        )


        # ====================================================
        # 10. Outputs
        # ====================================================

        sent = True

        seq = _udp_seq

        session = _udp_session_id

        packet = json.dumps(
            payload,
            indent=2,
            allow_nan=False
        )


        info = (
            "UDP Publisher: RUNNING\n"
            "Destination: {}:{}\n"
            "Robot: {}\n"
            "Session: {}\n"
            "Seq: {}\n"
            "Packets: {}\n"
            "Packet size: {} bytes\n"
            "Joint: {}\n"
            "Pose input: {}\n"
            "T_base_flange: OK\n"
            "det(R): {:.6f}\n"
            "Ortho error: {:.8f}\n"
            "State: {}"
        ).format(

            UDP_IP,
            UDP_PORT,

            ROBOT_ID,

            _udp_session_id,

            _udp_seq,

            _udp_packet_count,

            len(data),

            (
                "OK"
                if joints is not None
                else
                "NOT PROVIDED"
            ),

            pose_input_type,

            determinant,
            orthogonal_error,

            state_value
        )


    except Exception as e:

        sent = False

        seq = _udp_seq

        session = _udp_session_id

        info = (
            "UDP PUBLISH ERROR\n"
            "{}"
        ).format(
            e
        )
# ---------- end udp_publisher ----------
panel_28 = Panel(udp_publisher.info)

# ----
# Flange to Base Matrix
robot_pose = Python3Script(P=plane_2)  # -> out, M, T, info; inputs P: Plane
# ---------- robot_pose: Python ----------
import Rhino.Geometry as rg
import numpy as np

if P is None:
    M = None
    T = None
    info = "No flange plane"

else:

    O = P.Origin

    X = rg.Vector3d(P.XAxis)
    Y = rg.Vector3d(P.YAxis)
    Z = rg.Vector3d(P.ZAxis)

    X.Unitize()
    Y.Unitize()
    Z.Unitize()

    # ------------------------------------
    # 4x4 homogeneous transformation
    # T_base_flange
    # ------------------------------------

    T_np = np.array([
        [X.X, Y.X, Z.X, O.X],
        [X.Y, Y.Y, Z.Y, O.Y],
        [X.Z, Y.Z, Z.Z, O.Z],
        [0.0, 0.0, 0.0, 1.0]
    ], dtype=np.float64)

    # ------------------------------------
    # Panel 顯示用
    # ------------------------------------

    M = "\n".join(
        "[{:10.6f}  {:10.6f}  {:10.6f}  {:10.3f}]".format(
            row[0], row[1], row[2], row[3]
        )
        for row in T_np
    )

    # ------------------------------------
    # Rhino Transform
    # ------------------------------------

    T = rg.Transform.Identity

    T.M00 = T_np[0,0]
    T.M01 = T_np[0,1]
    T.M02 = T_np[0,2]
    T.M03 = T_np[0,3]

    T.M10 = T_np[1,0]
    T.M11 = T_np[1,1]
    T.M12 = T_np[1,2]
    T.M13 = T_np[1,3]

    T.M20 = T_np[2,0]
    T.M21 = T_np[2,1]
    T.M22 = T_np[2,2]
    T.M23 = T_np[2,3]

    # ------------------------------------
    # 檢查 Rotation Matrix
    # ------------------------------------

    R = T_np[:3, :3]

    determinant = np.linalg.det(R)

    orthogonal_error = np.linalg.norm(
        R.T @ R - np.eye(3)
    )

    info = (
        "T_base_flange\n"
        "det(R) = {:.6f}\n"
        "orthogonal error = {:.8f}"
    ).format(
        determinant,
        orthogonal_error
    )
# ---------- end robot_pose ----------
panel_29 = Panel(robot_pose.M)
panel_30 = Panel(robot_pose.info)

# ----
# Mesh From Pointcloud
# Delaunay
entwine = Entwine(Branch00=point_cloud_attributes.Locations, Branch01=point_cloud_attributes.Colours, FlattenInputs=True)  # disabled
data_dam = DataDam(DataDataA=entwine, BufferDelay=10000000, BufferMode=0)  # disabled
explode_tree = ExplodeTree(Data=data_dam)  # -> Branch0, Branch1; disabled
quad_remesh_settings = QuadRemeshSettings(TargetCount=5000, AdaptiveSize=0, AdaptiveCount=False, HardEdges=False, SeamEdges=0, Symmetry=0, GuideCurves=0)  # disabled
delaunay_mesh = DelaunayMesh(Points=explode_tree.Branch0, Plane=PlaneXY(0, 0, 0))  # disabled
data_dam_2 = DataDam(DataDataA=explode_tree.Branch1, BufferDelay=10000000, BufferMode=0)  # disabled
quad_remesh = QuadRemesh(Geometry=delaunay_mesh, Settings=quad_remesh_settings)  # disabled
mesh_spray = MeshSpray(Mesh=quad_remesh, Points=explode_tree.Branch0, Colours=data_dam_2, SprayMode=11)  # disabled

# ----
# Eye-in-Hand Calibration
construct_point = ConstructPoint(XCoordinate=1500, YCoordinate=0, ZCoordinate=0)
hand_eye_calibration = Python3Script(
    display_origin=construct_point,
    spacing="500",
    add=Button(),
    solve=Button(),
    reset=Button(),
    frame=maincapture.frame,
    xyz=maincapture.xyz,
    rgba=maincapture.rgba,
    T=robot_pose.T)  # -> out, count, status, M, T_FC, res, clouds, anchors; inputs display_origin: Point3d, spacing: Double, add: Boolean, solve: Boolean, reset: Boolean
# ---------- hand_eye_calibration: Python ----------
# venv: zivid-2-18
# requirements: zivid==2.18.0

import os
import datetime

import zivid
import numpy as np
import Rhino.Geometry as rg
import System.Drawing as sd


# ============================================================
# USER SETTINGS
# ============================================================

# Rhino Preview Downsample
#
# 例如原始 1944 x 1200：
#
# step = 8
# 約保留 1/64 points
#
# Rhino 太卡時可改：
# 10 / 12 / 16
#
PREVIEW_STEP = 8


# ------------------------------------------------------------
# Calibration output
#
# 正式輸出：
# <project root>/data/calibration/calibration_results.yaml
#
# Project root resolution priority:
# 1. KUKA_ZIVID_PROJECT_ROOT environment variable
# 2. Current Grasshopper document path -> walk upward
# 3. Current working directory -> walk upward
#
# The script deliberately does NOT delete this file on RESET.
# RESET only clears the current in-memory calibration session.
# ------------------------------------------------------------

CALIBRATION_RELATIVE_PATH = os.path.join(
    "data",
    "calibration",
    "calibration_results.yaml"
)


# ============================================================
# Persistent State
# ============================================================

# ------------------------------------------------------------
# Hand-Eye calibration samples
# ------------------------------------------------------------

if "_he_inputs" not in globals():
    _he_inputs = []


# ------------------------------------------------------------
# Hand-Eye result
# ------------------------------------------------------------

if "_he_result" not in globals():
    _he_result = None


# ------------------------------------------------------------
# T_flange_camera
# ------------------------------------------------------------

if "_T_FC_np" not in globals():
    _T_FC_np = None


# ------------------------------------------------------------
# Calibration residuals
# ------------------------------------------------------------

if "_residuals" not in globals():
    _residuals = []


# ------------------------------------------------------------
# Last saved calibration path
# ------------------------------------------------------------

if "_calibration_saved_path" not in globals():
    _calibration_saved_path = None


# ------------------------------------------------------------
# Status
# ------------------------------------------------------------

if "_status" not in globals():
    _status = "Ready"


# ============================================================
# Stored Scan Data
#
# 這裡保存的是 Calibration Sample 對應的資料
#
# xyz   = Camera Frame 原始 XYZ preview
# rgba  = 對應顏色
# TBF   = 該次 Robot Pose
#
# visualization translation 不會修改這些資料
# ============================================================

if "_stored_xyz" not in globals():
    _stored_xyz = []


if "_stored_rgba" not in globals():
    _stored_rgba = []


if "_stored_TBF" not in globals():
    _stored_TBF = []


# ============================================================
# Rhino Visualization Copies
# ============================================================

if "_display_clouds" not in globals():
    _display_clouds = []


if "_display_anchors" not in globals():
    _display_anchors = []


# ============================================================
# Button State
#
# 避免 Grasshopper recompute 時：
#
# ADD 被重複加入
# SOLVE 被重複執行
# RESET 被重複執行
# ============================================================

if "_prev_add" not in globals():
    _prev_add = False


if "_prev_solve" not in globals():
    _prev_solve = False


if "_prev_reset" not in globals():
    _prev_reset = False


add_now = (
    bool(add)
    and
    not _prev_add
)


solve_now = (
    bool(solve)
    and
    not _prev_solve
)


reset_now = (
    bool(reset)
    and
    not _prev_reset
)


_prev_add = bool(add)

_prev_solve = bool(solve)

_prev_reset = bool(reset)


# ============================================================
# Display Settings
# ============================================================

if display_origin is None:

    display_origin_use = rg.Point3d(
        3000.0,
        0.0,
        0.0
    )

else:

    display_origin_use = rg.Point3d(
        display_origin
    )


if spacing is None:

    spacing_use = 1500.0

else:

    spacing_use = float(
        spacing
    )


# ============================================================
# Helper
#
# Rhino Transform
# ->
# NumPy 4x4
# ============================================================

def rhino_to_numpy(T):

    return np.array(
        [
            [
                T.M00,
                T.M01,
                T.M02,
                T.M03
            ],

            [
                T.M10,
                T.M11,
                T.M12,
                T.M13
            ],

            [
                T.M20,
                T.M21,
                T.M22,
                T.M23
            ],

            [
                T.M30,
                T.M31,
                T.M32,
                T.M33
            ]
        ],

        dtype=np.float64
    )


# ============================================================
# Helper
#
# NumPy 4x4
# ->
# Rhino Transform
# ============================================================

def numpy_to_rhino(A):

    T_out = rg.Transform.Identity


    T_out.M00 = float(A[0, 0])
    T_out.M01 = float(A[0, 1])
    T_out.M02 = float(A[0, 2])
    T_out.M03 = float(A[0, 3])


    T_out.M10 = float(A[1, 0])
    T_out.M11 = float(A[1, 1])
    T_out.M12 = float(A[1, 2])
    T_out.M13 = float(A[1, 3])


    T_out.M20 = float(A[2, 0])
    T_out.M21 = float(A[2, 1])
    T_out.M22 = float(A[2, 2])
    T_out.M23 = float(A[2, 3])


    T_out.M30 = float(A[3, 0])
    T_out.M31 = float(A[3, 1])
    T_out.M32 = float(A[3, 2])
    T_out.M33 = float(A[3, 3])


    return T_out


# ============================================================
# Helper
#
# Matrix
# ->
# Grasshopper Panel Text
# ============================================================

def matrix_to_text(A):

    return "\n".join(

        [
            (
                "[{:10.6f}  "
                "{:10.6f}  "
                "{:10.6f}  "
                "{:10.3f}]"
            ).format(

                row[0],
                row[1],
                row[2],
                row[3]
            )

            for row in A
        ]
    )


# ============================================================
# Helper
#
# XYZ + RGBA
# ->
# Rhino Colored PointCloud
#
# Rhino Preview 使用 RGB。
#
# Zivid RGBA 的 A 仍保存在 _stored_rgba，
# 但 Rhino PointCloud 顯示主要使用 R/G/B。
# ============================================================

def numpy_to_colored_pointcloud(
    points,
    colors
):

    cloud = rg.PointCloud()


    if points is None:

        return cloud


    if colors is None:

        # ----------------------------------------
        # 如果沒有顏色
        # 仍然建立 Geometry
        # ----------------------------------------

        for p in points:

            cloud.Add(

                rg.Point3d(
                    float(p[0]),
                    float(p[1]),
                    float(p[2])
                )
            )

        return cloud


    # --------------------------------------------------------
    # Colored Point Cloud
    # --------------------------------------------------------

    for p, c in zip(
        points,
        colors
    ):

        point = rg.Point3d(
            float(p[0]),
            float(p[1]),
            float(p[2])
        )


        # ----------------------------------------
        # Zivid RGBA
        #
        # c[0] = R
        # c[1] = G
        # c[2] = B
        # c[3] = A
        #
        # Rhino viewport color 使用 RGB
        # ----------------------------------------

        color = sd.Color.FromArgb(
            int(c[0]),
            int(c[1]),
            int(c[2])
        )


        cloud.Add(
            point,
            color
        )


    return cloud


# ============================================================
# Helper
#
# Create Visualization Copy
#
# 只做：
#
# Translation
#
# 不做：
#
# Rotation
# Hand-Eye Transform
# Robot Transform
#
# 所以純粹只是 Rhino 視覺排列
# ============================================================

def create_display_cloud(
    xyz_points,
    rgba_colors,
    target_point
):

    if xyz_points is None:

        return None


    if len(xyz_points) == 0:

        return None


    # --------------------------------------------------------
    # XYZ Bounding Box
    # --------------------------------------------------------

    xyz_min = np.min(
        xyz_points,
        axis=0
    )


    xyz_max = np.max(
        xyz_points,
        axis=0
    )


    # --------------------------------------------------------
    # Point Cloud Bounding Box Center
    # --------------------------------------------------------

    bbox_center = (

        xyz_min
        +
        xyz_max

    ) * 0.5


    # --------------------------------------------------------
    # Target Anchor
    # --------------------------------------------------------

    target = np.array(

        [
            target_point.X,
            target_point.Y,
            target_point.Z
        ],

        dtype=np.float64
    )


    # --------------------------------------------------------
    # Translation Vector
    # --------------------------------------------------------

    move_vector = (

        target
        -
        bbox_center
    )


    # --------------------------------------------------------
    # Create translated COPY
    #
    # 原始 _stored_xyz 完全不變
    # --------------------------------------------------------

    xyz_display = (

        xyz_points
        +
        move_vector
    )


    # --------------------------------------------------------
    # Create Colored Rhino Point Cloud
    # --------------------------------------------------------

    cloud = numpy_to_colored_pointcloud(

        xyz_display,
        rgba_colors
    )


    return cloud


# ============================================================
# Helper
#
# Project Root / Calibration Path
# ============================================================

def _looks_like_project_root(path):

    if not path:
        return False

    return (
        os.path.isfile(
            os.path.join(path, "service.py")
        )
        and
        os.path.isfile(
            os.path.join(path, "config.example.yaml")
        )
    )


def _walk_up_for_project_root(start_path, max_levels=8):

    if not start_path:
        return None

    current = os.path.abspath(start_path)

    if os.path.isfile(current):
        current = os.path.dirname(current)

    for _ in range(max_levels + 1):

        if _looks_like_project_root(current):
            return current

        parent = os.path.dirname(current)

        if parent == current:
            break

        current = parent

    return None


def _grasshopper_document_path():

    try:
        import Grasshopper

        canvas = Grasshopper.Instances.ActiveCanvas

        if canvas is None:
            return None

        document = canvas.Document

        if document is None:
            return None

        file_path = document.FilePath

        if file_path:
            return str(file_path)

    except Exception:
        pass

    return None


def resolve_project_root():

    # --------------------------------------------------------
    # 1. Explicit environment variable
    # --------------------------------------------------------

    env_root = os.environ.get(
        "KUKA_ZIVID_PROJECT_ROOT"
    )

    if env_root:

        env_root = os.path.abspath(
            os.path.expanduser(
                os.path.expandvars(env_root)
            )
        )

        return env_root


    # --------------------------------------------------------
    # 2. Current Grasshopper document
    # --------------------------------------------------------

    gh_path = _grasshopper_document_path()

    if gh_path:

        found = _walk_up_for_project_root(
            gh_path
        )

        if found:
            return found

        # Project layout is normally:
        # project_root/grasshopper/KUKA_Zivid_Bridge.gh
        gh_dir = os.path.dirname(
            os.path.abspath(gh_path)
        )

        if os.path.basename(gh_dir).lower() == "grasshopper":
            return os.path.dirname(gh_dir)

        return gh_dir


    # --------------------------------------------------------
    # 3. Current working directory
    # --------------------------------------------------------

    cwd = os.getcwd()

    found = _walk_up_for_project_root(
        cwd
    )

    if found:
        return found

    return os.path.abspath(cwd)


def calibration_output_path():

    return os.path.join(
        resolve_project_root(),
        CALIBRATION_RELATIVE_PATH
    )


# ============================================================
# Helper
#
# Calibration validation before persistence
# ============================================================

def validate_calibration_matrix(T_FC):

    A = np.asarray(
        T_FC,
        dtype=np.float64
    )

    if A.shape != (4, 4):
        raise ValueError(
            "T_flange_camera must be 4 x 4. Current shape: {}".format(
                A.shape
            )
        )

    if not np.isfinite(A).all():
        raise ValueError(
            "T_flange_camera contains NaN or Inf"
        )

    expected_last_row = np.array(
        [0.0, 0.0, 0.0, 1.0],
        dtype=np.float64
    )

    if not np.allclose(
        A[3, :],
        expected_last_row,
        atol=1e-8
    ):
        raise ValueError(
            "T_flange_camera last row is not [0, 0, 0, 1]"
        )

    R = A[:3, :3]

    det_R = float(
        np.linalg.det(R)
    )

    ortho_error = float(
        np.linalg.norm(
            R.T @ R - np.eye(3)
        )
    )

    if abs(det_R - 1.0) > 0.01:
        raise ValueError(
            "Invalid calibration rotation: det(R) = {:.8f}".format(
                det_R
            )
        )

    if ortho_error > 0.01:
        raise ValueError(
            "Invalid calibration rotation: orthogonality error = {:.8f}".format(
                ortho_error
            )
        )

    return det_R, ortho_error


# ============================================================
# Helper
#
# YAML persistence
#
# No PyYAML dependency is required here. The writer is kept
# deliberately explicit so this Grasshopper component still
# works in a minimal zivid-only Python environment.
# ============================================================

def _yaml_number(value):

    return "{:.12g}".format(
        float(value)
    )


def _yaml_quote(value):

    text = str(value)

    text = text.replace(
        "\\",
        "\\\\"
    )

    text = text.replace(
        '"',
        '\\"'
    )

    text = text.replace(
        "\n",
        "\\n"
    )

    return '"{}"'.format(
        text
    )


def _residual_records(residuals):

    records = []

    for i, residual in enumerate(residuals):

        records.append(
            {
                "sample": i + 1,
                "rotation_deg": float(
                    residual.rotation()
                ),
                "translation_mm": float(
                    residual.translation()
                )
            }
        )

    return records


def _residual_summary(records):

    if not records:

        return {
            "rotation_mean_deg": None,
            "rotation_max_deg": None,
            "translation_mean_mm": None,
            "translation_max_mm": None
        }

    rotations = np.asarray(
        [
            r["rotation_deg"]
            for r in records
        ],
        dtype=np.float64
    )

    translations = np.asarray(
        [
            r["translation_mm"]
            for r in records
        ],
        dtype=np.float64
    )

    return {
        "rotation_mean_deg": float(
            np.mean(rotations)
        ),
        "rotation_max_deg": float(
            np.max(rotations)
        ),
        "translation_mean_mm": float(
            np.mean(translations)
        ),
        "translation_max_mm": float(
            np.max(translations)
        )
    }


def build_calibration_yaml(
    T_FC,
    residuals,
    sample_count
):

    det_R, ortho_error = validate_calibration_matrix(
        T_FC
    )

    A = np.asarray(
        T_FC,
        dtype=np.float64
    )

    records = _residual_records(
        residuals
    )

    summary = _residual_summary(
        records
    )

    timestamp = datetime.datetime.now(
        datetime.timezone.utc
    ).replace(
        microsecond=0
    ).isoformat().replace(
        "+00:00",
        "Z"
    )

    lines = []

    lines.append("schema_version: 1")
    lines.append("calibration_type: eye_in_hand")
    lines.append("method: zivid.calibration.calibrate_eye_in_hand")
    lines.append("created_at: {}".format(_yaml_quote(timestamp)))
    lines.append("source: grasshopper_hand_eye")

    # This component is intended for real Eye-in-Hand solving.
    # Explicitly mark the artifact as non-mock so the external
    # service can keep mock/real calibration separated.
    lines.append("mock: false")
    lines.append("is_mock: false")

    lines.append("transform_convention: T_target_source")
    lines.append("units: mm")
    lines.append("source_frame: camera")
    lines.append("target_frame: flange")
    lines.append("transform_name: T_flange_camera")
    lines.append("sample_count: {}".format(int(sample_count)))

    # --------------------------------------------------------
    # Primary compatibility key used by the production chain:
    # T_base_camera = T_base_flange @ T_flange_camera
    # --------------------------------------------------------

    lines.append("T_flange_camera:")

    for row in A:

        row_text = ", ".join(
            _yaml_number(value)
            for value in row
        )

        lines.append(
            "  - [{}]".format(
                row_text
            )
        )

    # --------------------------------------------------------
    # Explicit semantic transform metadata
    # --------------------------------------------------------

    lines.append("transform:")
    lines.append("  name: T_flange_camera")
    lines.append("  source_frame: camera")
    lines.append("  target_frame: flange")
    lines.append("  units: mm")
    lines.append("  matrix:")

    for row in A:

        row_text = ", ".join(
            _yaml_number(value)
            for value in row
        )

        lines.append(
            "    - [{}]".format(
                row_text
            )
        )

    # --------------------------------------------------------
    # Residuals
    # --------------------------------------------------------

    lines.append("residuals:")

    if records:

        for record in records:

            lines.append(
                "  - sample: {}".format(
                    record["sample"]
                )
            )

            lines.append(
                "    rotation_deg: {}".format(
                    _yaml_number(
                        record["rotation_deg"]
                    )
                )
            )

            lines.append(
                "    translation_mm: {}".format(
                    _yaml_number(
                        record["translation_mm"]
                    )
                )
            )

    else:

        lines.append("  []")

    # --------------------------------------------------------
    # Summary / numeric matrix validation
    # --------------------------------------------------------

    lines.append("quality:")
    lines.append(
        "  rotation_mean_deg: {}".format(
            "null"
            if summary["rotation_mean_deg"] is None
            else _yaml_number(summary["rotation_mean_deg"])
        )
    )
    lines.append(
        "  rotation_max_deg: {}".format(
            "null"
            if summary["rotation_max_deg"] is None
            else _yaml_number(summary["rotation_max_deg"])
        )
    )
    lines.append(
        "  translation_mean_mm: {}".format(
            "null"
            if summary["translation_mean_mm"] is None
            else _yaml_number(summary["translation_mean_mm"])
        )
    )
    lines.append(
        "  translation_max_mm: {}".format(
            "null"
            if summary["translation_max_mm"] is None
            else _yaml_number(summary["translation_max_mm"])
        )
    )
    lines.append(
        "  rotation_det: {}".format(
            _yaml_number(det_R)
        )
    )
    lines.append(
        "  rotation_orthogonality_error: {}".format(
            _yaml_number(ortho_error)
        )
    )

    # Final newline is intentional for normal text-file behavior.
    return "\n".join(lines) + "\n"


def save_calibration_yaml(
    T_FC,
    residuals,
    sample_count
):

    output_path = calibration_output_path()

    output_dir = os.path.dirname(
        output_path
    )

    os.makedirs(
        output_dir,
        exist_ok=True
    )

    yaml_text = build_calibration_yaml(
        T_FC,
        residuals,
        sample_count
    )

    # --------------------------------------------------------
    # Atomic write
    #
    # Consumers should never observe a half-written production
    # calibration file.
    # --------------------------------------------------------

    temp_path = output_path + ".tmp"

    try:

        with open(
            temp_path,
            "w",
            encoding="utf-8",
            newline="\n"
        ) as file_handle:

            file_handle.write(
                yaml_text
            )

            file_handle.flush()

            try:
                os.fsync(
                    file_handle.fileno()
                )
            except Exception:
                # Some hosted/interpreted environments may not
                # expose fsync normally. os.replace still gives
                # the important atomic promotion behavior.
                pass

        os.replace(
            temp_path,
            output_path
        )

    except Exception:

        try:
            if os.path.isfile(temp_path):
                os.remove(temp_path)
        except Exception:
            pass

        raise

    return output_path


# ============================================================
# RESET
# ============================================================

if reset_now:

    # --------------------------------------------------------
    # Hand-Eye data
    # --------------------------------------------------------

    _he_inputs = []

    _he_result = None

    _T_FC_np = None

    _residuals = []


    # --------------------------------------------------------
    # Stored Scan data
    # --------------------------------------------------------

    _stored_xyz = []

    _stored_rgba = []

    _stored_TBF = []


    # --------------------------------------------------------
    # Rhino Preview
    # --------------------------------------------------------

    _display_clouds = []

    _display_anchors = []


    # --------------------------------------------------------
    # IMPORTANT
    #
    # Do NOT delete calibration_results.yaml here.
    # RESET means reset current collection session, not remove
    # the last committed production calibration artifact.
    # --------------------------------------------------------


    # --------------------------------------------------------
    # Status
    # --------------------------------------------------------

    _status = (

        "RESET OK\n"

        "Hand-Eye dataset cleared\n"

        "Stored XYZ cleared\n"

        "Stored RGBA cleared\n"

        "Stored robot poses cleared\n"

        "Rhino preview cleared\n"

        "Saved calibration file kept"
    )


# ============================================================
# ADD SAMPLE
# ============================================================

elif add_now:

    # --------------------------------------------------------
    # Input Check
    # --------------------------------------------------------

    if frame is None:

        _status = (

            "ADD ERROR\n"
            "No Zivid frame"
        )


    elif xyz is None:

        _status = (

            "ADD ERROR\n"
            "No XYZ data"
        )


    elif rgba is None:

        _status = (

            "ADD ERROR\n"
            "No RGBA data"
        )


    elif T is None:

        _status = (

            "ADD ERROR\n"
            "No T_base_flange"
        )


    else:

        try:

            # =================================================
            # 1.
            # Freeze Current Robot Pose
            # =================================================

            T_BF = rhino_to_numpy(
                T
            )


            # =================================================
            # 2.
            # Rotation Matrix Check
            # =================================================

            R = T_BF[
                :3,
                :3
            ]


            det_R = np.linalg.det(
                R
            )


            ortho_error = np.linalg.norm(

                R.T
                @
                R
                -
                np.eye(3)
            )


            if abs(

                det_R
                -
                1.0

            ) > 0.01:

                raise ValueError(

                    (
                        "Invalid robot rotation matrix: "
                        "det(R) = {:.6f}"
                    ).format(
                        det_R
                    )
                )


            # =================================================
            # 3.
            # Robot Pose
            # ->
            # Zivid Pose
            # =================================================

            robot_pose = (

                zivid.calibration.Pose(
                    T_BF
                )
            )


            # =================================================
            # 4.
            # Detect Calibration Board
            #
            # 使用 Python② 的 SAME FRAME
            # =================================================

            detection = (

                zivid.calibration
                .detect_calibration_board(
                    frame
                )
            )


            # =================================================
            # 5.
            # Board Detection Validation
            # =================================================

            if not detection.valid():

                _status = (

                    "ADD FAILED\n"

                    "Calibration Board "
                    "not detected\n"

                    "{}"

                ).format(

                    detection
                    .status_description()
                )


            else:

                # =============================================
                # 6.
                # Robot Pose
                # +
                # Board Detection
                # =
                # HandEyeInput
                # =============================================

                sample = (

                    zivid.calibration
                    .HandEyeInput(

                        robot_pose,
                        detection
                    )
                )


                # =============================================
                # 7.
                # Save Hand-Eye Sample
                # =============================================

                _he_inputs.append(
                    sample
                )


                # =============================================
                # 8.
                # Save Robot Pose
                #
                # copy 很重要
                # =============================================

                _stored_TBF.append(

                    T_BF.copy()
                )


                # =============================================
                # 9.
                # Convert incoming XYZ / RGBA to NumPy
                #
                # 注意：
                # 不再從 frame 重抓 PointCloud
                # =============================================

                xyz_np = np.asarray(
                    xyz
                )


                rgba_np = np.asarray(
                    rgba
                )


                # =============================================
                # 10.
                # Shape Validation
                # =============================================

                if xyz_np.ndim != 3:

                    raise ValueError(

                        (
                            "XYZ must be H x W x 3. "
                            "Current shape: {}"
                        ).format(
                            xyz_np.shape
                        )
                    )


                if rgba_np.ndim != 3:

                    raise ValueError(

                        (
                            "RGBA must be H x W x 4. "
                            "Current shape: {}"
                        ).format(
                            rgba_np.shape
                        )
                    )


                if xyz_np.shape[0:2] != rgba_np.shape[0:2]:

                    raise ValueError(

                        (
                            "XYZ / RGBA resolution mismatch\n"
                            "XYZ: {}\n"
                            "RGBA: {}"
                        ).format(

                            xyz_np.shape,
                            rgba_np.shape
                        )
                    )


                # =============================================
                # 11.
                # Downsample XYZ
                # =============================================

                xyz_preview = (

                    xyz_np[
                        ::PREVIEW_STEP,
                        ::PREVIEW_STEP,
                        :
                    ]

                    .reshape(
                        -1,
                        3
                    )
                )


                # =============================================
                # 12.
                # Downsample RGBA
                #
                # 完全相同 Pixel Index
                # =============================================

                rgba_preview = (

                    rgba_np[
                        ::PREVIEW_STEP,
                        ::PREVIEW_STEP,
                        :
                    ]

                    .reshape(
                        -1,
                        rgba_np.shape[2]
                    )
                )


                # =============================================
                # 13.
                # Remove invalid XYZ
                # =============================================

                valid = np.isfinite(

                    xyz_preview

                ).all(
                    axis=1
                )


                # =============================================
                # 14.
                # SAME MASK applied to XYZ + RGBA
                #
                # 所以 Point / Color 永遠保持對應
                # =============================================

                xyz_preview = (

                    xyz_preview[
                        valid
                    ]
                )


                rgba_preview = (

                    rgba_preview[
                        valid
                    ]
                )


                # =============================================
                # 15.
                # Store Raw Camera-frame XYZ
                # =============================================

                _stored_xyz.append(

                    xyz_preview.copy()
                )


                # =============================================
                # 16.
                # Store corresponding RGBA
                # =============================================

                _stored_rgba.append(

                    rgba_preview.copy()
                )


                # =============================================
                # 17.
                # Calculate Display Position
                #
                # Sample 01:
                # origin
                #
                # Sample 02:
                # origin + spacing
                #
                # Sample 03:
                # origin + spacing * 2
                # =============================================

                sample_index = (

                    len(_he_inputs)
                    -
                    1
                )


                anchor = rg.Point3d(

                    display_origin_use.X
                    +
                    sample_index
                    *
                    spacing_use,

                    display_origin_use.Y,

                    display_origin_use.Z
                )


                # =============================================
                # 18.
                # Create Colored Visualization Copy
                # =============================================

                display_cloud = (

                    create_display_cloud(

                        xyz_preview,
                        rgba_preview,
                        anchor
                    )
                )


                # =============================================
                # 19.
                # Store Rhino Preview
                # =============================================

                _display_clouds.append(

                    display_cloud
                )


                _display_anchors.append(

                    anchor
                )


                # =============================================
                # 20.
                # Status
                # =============================================

                _status = (

                    "ADD OK\n"

                    "Sample #{:02d}\n"

                    "Board detected\n"

                    "Preview points: {}\n"

                    "RGBA: YES\n"

                    "Display center: "
                    "({:.1f}, {:.1f}, {:.1f})\n"

                    "det(R) = {:.6f}\n"

                    "Ortho error = {:.8f}"

                ).format(

                    len(_he_inputs),

                    len(xyz_preview),

                    anchor.X,
                    anchor.Y,
                    anchor.Z,

                    det_R,
                    ortho_error
                )


        except Exception as e:

            _status = (

                "ADD ERROR\n{}"

            ).format(
                e
            )


# ============================================================
# SOLVE EYE-IN-HAND
# ============================================================

elif solve_now:

    # --------------------------------------------------------
    # 2 poses 僅允許拿來測試程式
    #
    # 正式 Hand-Eye 要收更多 diversified poses
    # --------------------------------------------------------

    if len(
        _he_inputs
    ) < 2:

        _status = (

            "SOLVE ERROR\n"

            "Not enough samples\n"

            "Current samples: {}"

        ).format(

            len(_he_inputs)
        )


    else:

        try:

            # =================================================
            # Eye-In-Hand Calibration
            # =================================================

            result = (

                zivid.calibration
                .calibrate_eye_in_hand(

                    _he_inputs
                )
            )


            # =================================================
            # Validate Result
            # =================================================

            if not result.valid():

                _status = (

                    "SOLVE FAILED\n"

                    "Hand-Eye result is invalid"
                )


            else:

                _he_result = (
                    result
                )


                # =============================================
                # T_flange_camera
                # =============================================

                _T_FC_np = np.asarray(

                    result.transform(),

                    dtype=np.float64
                )


                # =============================================
                # Residuals
                # =============================================

                _residuals = (

                    result.residuals()
                )


                # =============================================
                # Persist calibration artifact
                #
                # Only a VALID Zivid result reaches this point.
                # =============================================

                try:

                    _calibration_saved_path = (

                        save_calibration_yaml(

                            _T_FC_np,
                            _residuals,
                            len(_he_inputs)
                        )
                    )


                    # =========================================
                    # Status - Solve + Save both OK
                    # =========================================

                    _status = (

                        "SOLVE OK\n"

                        "Eye-In-Hand Calibration\n"

                        "Samples: {}\n"

                        "T_flange_camera ready\n"

                        "Residuals: {}\n"

                        "Stored colored clouds: {}\n"

                        "YAML SAVED\n"

                        "{}"

                    ).format(

                        len(_he_inputs),

                        len(_residuals),

                        len(_display_clouds),

                        _calibration_saved_path
                    )


                except Exception as save_error:

                    # =========================================
                    # The calibration math succeeded and the
                    # result stays available in M / T_FC / res,
                    # but persistence failed. Make the distinction
                    # explicit instead of pretending SOLVE failed.
                    # =========================================

                    _status = (

                        "SOLVE OK / YAML SAVE ERROR\n"

                        "Eye-In-Hand Calibration computed\n"

                        "Samples: {}\n"

                        "T_flange_camera ready in memory\n"

                        "Residuals: {}\n"

                        "YAML was NOT committed\n"

                        "{}"

                    ).format(

                        len(_he_inputs),

                        len(_residuals),

                        save_error
                    )


        except Exception as e:

            _status = (

                "SOLVE ERROR\n{}"

            ).format(
                e
            )


# ============================================================
# OUTPUTS
# ============================================================

count = len(
    _he_inputs
)


status = _status


# ============================================================
# Calibration Matrix Outputs
# ============================================================

if _T_FC_np is not None:

    # --------------------------------------------------------
    # Panel-readable Matrix
    # --------------------------------------------------------

    M = matrix_to_text(
        _T_FC_np
    )


    # --------------------------------------------------------
    # Rhino Transform
    # --------------------------------------------------------

    T_FC = numpy_to_rhino(
        _T_FC_np
    )


else:

    M = None

    T_FC = None


# ============================================================
# Residual Output
# ============================================================

if len(
    _residuals
) > 0:

    residual_lines = []


    for i, r in enumerate(
        _residuals
    ):

        residual_lines.append(

            (
                "#{:02d} | "
                "Rotation: {:.6f} deg | "
                "Translation: {:.6f} mm"
            ).format(

                i + 1,

                r.rotation(),

                r.translation()
            )
        )


    res = "\n".join(
        residual_lines
    )


else:

    res = None


# ============================================================
# Rhino Visualization Outputs
# ============================================================

clouds = _display_clouds

anchors = _display_anchors
# ---------- end hand_eye_calibration ----------
point_cloud = PointCloud(hand_eye_calibration.clouds)
panel_31 = Panel(hand_eye_calibration.count)
panel_32 = Panel(hand_eye_calibration.status)
panel_33 = Panel(hand_eye_calibration.res)
panel_34 = Panel(hand_eye_calibration.M)

# ==== cluster Cluster
text = ClusterInput()
panel = Panel(""" /
\
""")
text_split = TextSplit(Text=text, Separators=panel)
list_item = ListItem(List=text_split, Index=-1, Wrap=True)  # -> flatten(Item)
i = ClusterOutput(list_item)

# ==== cluster PlaneAxis: show plane X Y Z axis.
P = ClusterInput()
B = ClusterInput()
deplane = DeconstructPlane(Plane=graft(P))  # -> Origin, XAxis, YAxis, ZAxis
multiplication = Multiplication(A=[deplane.XAxis, deplane.YAxis, deplane.ZAxis], B=B)
vdisex = VectorDisplayEx(
    Point=deplane.Origin,
    Vector=multiplication,
    Colour=[ColourSwatch(SwatchColor=RGB(235, 52, 52)), ColourSwatch(SwatchColor=RGB(90, 207, 48)), ColourSwatch(SwatchColor=RGB(54, 126, 227))],
    Width=2)
